# Grasshopper definition tAPIr_demo_done.gh (Grasshopper 1.0.7)

getbuiltinpropertyid = GetBuiltInPropertyID(PropertyType=15, Property=1)  # -> PropertyGroups, PropertiesOfType, PropertyID; inputs PropertyType: Int32
# ---------- getbuiltinpropertyid: Python ----------
ghenv.Component.Name = 'Get BuiltIn Property ID'
ghenv.Component.NickName = 'GetBuiltInPropertyID'
ghenv.Component.Message = '0.1'
ghenv.Component.Category = 'ARCHICAD'
ghenv.Component.SubCategory = 'API3'
ghenv.Component.Description = '''
Checks avaliable connection ports and dallows to pick one or all
INPUT:
	PropertyType    : int  		: Picks Property group
	Property        : int  		: Picks properties in group
						  

OUTPUT:
	PropertyGroups 	: Message 	:Property groups based on name prefix 
	PropertiesOfType 	: Message 	:properties in group

	PropertyID 			: string 	: GUID of property
'''


import api2 as api 

#read avaliable ports from GH global (sticky)
ports = api.get_port()
if ports == False:
    port = 0
else:
    port = ports[0]


if ports != False and len(ports)>0 and (PropertyType is not None and Property is not None):

	property_names = api.getBuiltInPropertyNames(port) # get names of builtIn properties
	property_types = api.getBuiltInPropertyTypes(port) # get types from names (first word before underscore)

	PropertyType_wrapped = api.get_wrapped_value(PropertyType,property_types) # wrapup input number slide node to fit list lenngth
	PropertyGroups  = api.show_menu('PROPERTY TYPES',property_types,PropertyType_wrapped)

	_properties_of_type = api.getBuiltInPropertiesOfType(property_names,port,property_types[PropertyType_wrapped]) 

	Property_wrapped = api.get_wrapped_value(Property,_properties_of_type)
	PropertiesOfType = api.show_menu('{} PROPERTIES'.format(property_types[PropertyType_wrapped]), _properties_of_type,Property_wrapped)

	property_name = _properties_of_type[Property_wrapped]

	# PropertyID = property_name
	PropertyID = api.getBuiltInPropertyId(property_name,port)

else:
	PropertyGroups = 'Plug INPUTS'
# ---------- end getbuiltinpropertyid ----------
getelementsbytype = GetAllElementsByType(ElementType=Slider(3, range=0..17), SerializeElements=True)  # -> printToPanel, ElementsOfType; inputs ElementType: Int32, SerializeElements: Boolean
# ---------- getelementsbytype: Python ----------
ghenv.Component.Name = 'Get All elements by Type'
ghenv.Component.NickName = 'GetElementsByType'
ghenv.Component.Message = '0.1'
ghenv.Component.Category = 'ARCHICAD'
ghenv.Component.SubCategory = 'API3'
ghenv.Component.Description = '''
Collects GUIDS of all elements in a project by thier type
INPUT:
	ElementType  : int Choose type. Connect Number slider from 0 to 17
				
OUTPUT:
	printToPanel 	: string - Display list of all types. 
	ElementsOfType 	: dict - Elements packed to dictionary
'''

import api2 as p
reload(p)

ports = p.get_active_port()

el_types = p.getElementsTypes()

if ElementType is not None and isinstance(ElementType,int):
	wrapped_ElementType = p.get_wrapped_value(ElementType,el_types)

	printToPanel = p.show_menu('Element Types',el_types,wrapped_ElementType)

	choosen_type = el_types[wrapped_ElementType]


	_ElementsOfType=[]
	for port in ports:
		elem = p.getElementsByType(choosen_type,port)
		elem = p.unpack(elem)['elements']
		_ElementsOfType+=elem
	if SerializeElements:   
		ElementsOfType = p.packlist(_ElementsOfType)
	else:
		ElementsOfType = _ElementsOfType

	# ElementsOfType = p.pack('elements',_ElementsOfType)
else:
	printToPanel = 'CAUTION:\nConnect Number Slider to <ElementType> Input'
# ---------- end getelementsbytype ----------

# ----
# Get ID Property
panel = Panel(getbuiltinpropertyid.PropertyGroups)
panel_2 = Panel(getbuiltinpropertyid.PropertyID)
panel_3 = Panel(getbuiltinpropertyid.PropertiesOfType)

# ----
# Elements collection
panel_4 = Panel(getelementsbytype.ElementsOfType)
panel_5 = Panel(getelementsbytype.printToPanel)

getuseerdefinedpropertyid = GetUserDefinedPropertyID(PropertyGroup=Slider(16, range=0..100), Property=0)  # -> printToPanel, PropertyGroups, PropertiesInGroup, PropertyID; inputs PropertyGroup: Int32, Property: Int32
# ---------- getuseerdefinedpropertyid: Python ----------
ghenv.Component.Name = 'Get UserDefined Property ID'
ghenv.Component.NickName = 'GetUseerDefinedPropertyID'
ghenv.Component.Message = '0.1'
ghenv.Component.Category = 'ARCHICAD'
ghenv.Component.SubCategory = 'API3'
ghenv.Component.Description = '''
Picks GUID of User defined Property
INPUT:
	PropertyGroup    : int  		: Picks Property group
	Property         : int  		: Picks properties in a group
						  

OUTPUT:
	printToPanel 	    : Message 	 
	PropertyGroups 	    : Message 	:Property groups based on name prefix 
	PropertiesInGroup	: Message 	:properties in a group

	PropertyID 			: string 	: GUID of property
'''


import api2 as api 
reload(api)
ports = api.get_port()
port = ports[0]

run  = api.get_global_toggle()
print 'sdfs',run
ud_groups , ud_properties = api.getUserDefinedPropertyGroups(port)

if len(ports)>0 or PropertyGroups is not None and Property is not None: 
	PropertyGroup_wrapped = api.get_wrapped_value(PropertyGroup,ud_groups) 
	_group = ud_groups[PropertyGroup_wrapped]
	_properties_in_group = ud_properties[_group]
	Property_wrapped = api.get_wrapped_value(Property,_properties_in_group) 
	print 	Property,Property_wrapped

	PropertyGroups = api.show_menu('GROUPS',ud_groups,PropertyGroup_wrapped)



	PropertiesInGroup = api.show_menu(
		'PROPERTIES IN GROUP "{}"'.format(_group),
		_properties_in_group,
		Property_wrapped
		)
	_property_name = _properties_in_group[Property_wrapped]

	if run:
		PropertyID  = api.getUserDefinedPropertyId(_group,_property_name,port)
		printToPanel = 'Global toggle is on'
	else:
		PropertyID  = ''
		printToPanel = 'GH scheme is globally turned off. Use Input <RunGlobally> in PickPort Node\n'
		

else:
	printToPanel = '''
INPUT:
	PropertyGroups: int
	Property: 		int
OUTPUT:
	PropertyGroups 		:list of groups printed to Panel node
	PropertiesInGroup 	:list of properties in chosen group  printed to Panel node
	PropertyID 			:str Property GUID as string
	'''

# choosen_property_name = ud_properties[Property_wrapped]
# ---------- end getuseerdefinedpropertyid ----------
getbuiltinpropertyid_2 = GetBuiltInPropertyID(PropertyType=15, Property=Slider(15, range=0..100))  # -> PropertyGroups, PropertiesOfType, PropertyID; inputs PropertyType: Int32; same code as getbuiltinpropertyid
getpropertyvalue = GetPropertyValue(PropertyID=panel_2, ElementsID=panel_4, SerializeList=1)  # -> PropertyValue; inputs SerializeList: Boolean
# ---------- getpropertyvalue: Python ----------
ghenv.Component.Name = 'Get Property Value'
ghenv.Component.NickName = 'GetPropertyValue'
ghenv.Component.Message = '0.1'
ghenv.Component.Category = 'ARCHICAD'
ghenv.Component.SubCategory = 'API3'
ghenv.Component.Description = '''
Gets value of given property GUID
INPUT:
	PropertyID         : string  : GUID of Property
	ElementsID         : dict    : dictionary of elements GUID
	UnpackValue        : dict    : dictionary of elements GUID
						  

OUTPUT:
	PropertyValue 	    : dict 	 : Dicionary with 3 keys: value,type and status
	
'''


import api2 as api 

ports = api.get_port()
port = ports[0]


if len(ports)>0 and (PropertyID is not None and ElementsID is not None):
	# if isinstance(ElementsID,str):
	if len(ElementsID)!=36:
		ElementsID = api.unpack(ElementsID)
	else:
		ElementsID = [ElementsID]


	property_value = api.getPropertyValue(ElementsID,[PropertyID],port)
	# print property_value



# ports = api.get_port()
# port = ports[0]

values=[]
if len(ports)>0 and (PropertyID is not None and ElementsID is not None):
	el = ElementsID
	# el = api.unpack(ElementsID)
	# el = api.unpack(ElementsID)['elements']
	property_value = api.getPropertyValue(el,[PropertyID],port)
	for i in property_value:
		values.append(i)
		# values.append(i['value'])

	if SerializeList:
		PropertyValue = api.packlist(property_value)	
	else:
		__val=[]
		for i in values:
			__val.append(i['value'])
			PropertyValue = __val
		# PropertyValue = values
# ---------- end getpropertyvalue ----------

# ----
# Get RelatedZoneNumber
panel_6 = Panel(getbuiltinpropertyid_2.PropertyID)
panel_7 = Panel(getbuiltinpropertyid_2.PropertyGroups)
panel_8 = Panel(getbuiltinpropertyid_2.PropertiesOfType)

panel_9 = Panel(getuseerdefinedpropertyid.PropertyID)

# ----
# Get Story Name from User Defined Property
panel_10 = Panel(getuseerdefinedpropertyid.PropertyGroups)
panel_11 = Panel(getuseerdefinedpropertyid.PropertiesInGroup)

deserializeproperty = DeserializeProperty(SerializedProperty=getpropertyvalue)  # -> PropertyValue, PropertyType, PropertyStatus
# ---------- deserializeproperty: Python ----------
ghenv.Component.Name = 'Deserialize Property'
ghenv.Component.NickName = 'DeserializeProperty'
ghenv.Component.Message = '0.1'
ghenv.Component.Category = 'ARCHICAD'
ghenv.Component.SubCategory = 'API3'
ghenv.Component.Description = '''
Deserialize json object that represents property dictionary
				
OUTPUT:
	
'''

import api2 as api

if SerializedProperty is not None:
	lista=[]
	lista = api.unpack(SerializedProperty)
	print lista
	# key_value = lista.items()
	# key = key_value[0][0]
	# _Values = lista[key]


	_ParameterValue=[]
	_ParameterType=[]
	_ParameterStatus=[]

	for v in lista:
		_ParameterValue.append(v['value'])
		_ParameterType.append(v['type'])
		_ParameterStatus.append(v['status'])

	PropertyValue= _ParameterValue
	PropertyType= _ParameterType
	PropertyStatus= _ParameterStatus
# ---------- end deserializeproperty ----------

# ----
# Get Property Value
panel_12 = Panel(getpropertyvalue)
panel_13 = Panel(deserializeproperty.PropertyValue)

panel_14 = Panel(getelementsbytype.ElementsOfType)
getpropertyvalue_2 = GetPropertyValue(PropertyID=panel_6, ElementsID=panel_14, SerializeList=1)  # -> PropertyValue; inputs SerializeList: Boolean; same code as getpropertyvalue
getpropertyvalue_3 = GetPropertyValue(PropertyID=panel_9, ElementsID=panel_14, SerializeList=1)  # -> PropertyValue; inputs SerializeList: Boolean; same code as getpropertyvalue
deserializeproperty_2 = DeserializeProperty(SerializedProperty=getpropertyvalue_2)  # -> PropertyValue, PropertyType, PropertyStatus; same code as deserializeproperty

# ----
# Get Related Zone Number VALUE
panel_15 = Panel(getpropertyvalue_2)
panel_16 = Panel(deserializeproperty_2.PropertyValue)

deserializeproperty_3 = DeserializeProperty(SerializedProperty=getpropertyvalue_3)  # -> PropertyValue, PropertyType, PropertyStatus; same code as deserializeproperty

# ----
# Get Related Zone Number
panel_17 = Panel(getpropertyvalue_3)
panel_18 = Panel(deserializeproperty_3.PropertyValue)

# ----
# Construct New ID
# Room Number
panel_19 = Panel(panel_16)
# Floor Number
panel_20 = Panel(panel_18)
# Prefix
panel_21 = Panel("W")
# Separator
panel_22 = Panel("_")

panel_23 = Panel(panel_13)
concatenate = Concatenate(FragmentA=panel_21, FragmentB=panel_22)
concatenate_2 = Concatenate(FragmentA=concatenate, FragmentB=panel_20)
concatenate_3 = Concatenate(FragmentA=concatenate_2, FragmentB=panel_22)
list_length = ListLength(List=panel_20)
concatenate_4 = Concatenate(FragmentA=concatenate_3, FragmentB=panel_19)
concatenate_5 = Concatenate(FragmentA=concatenate_4, FragmentB=panel_22)
series = Series(Start=0, Step=1, Count=list_length)
concatenate_6 = Concatenate(FragmentA=concatenate_5, FragmentB=series)
# New Values for ID
panel_24 = Panel(getbuiltinpropertyid.PropertyID)
panel_25 = Panel(getelementsbytype.ElementsOfType)
panel_26 = Panel(concatenate_6)
serialize_list = SerializeList(list=panel_26)
# Set New Values for ID
setpropertyvalue = SetPropertyValue(PropertyID=panel_24, ElementsID=panel_25, SetValue=serialize_list)  # -> printToPanel; disabled
# ---------- setpropertyvalue: Python ----------
ghenv.Component.Name = 'Set Property Value'
ghenv.Component.NickName = 'SetPropertyValue'
ghenv.Component.Message = '0.1'
ghenv.Component.Category = 'ARCHICAD'
ghenv.Component.SubCategory = 'API3'
ghenv.Component.Description = '''
Sets value of given property GUID
INPUT:
	PropertyID         : string  : GUID of Property
	ElementsID         : dict    : dictionary of elements GUID
	SetValue           : dict    : values packed
						  

OUTPUT:
	PropertyValue 	    : dict 	 : Dicionary with 3 keys: value,type and status
	
'''

import api2 as api
reload(api)


ports = api.get_port()
port = ports[0]

run = api.get_global_toggle()

# def convert_types(value,type_name):
# 	if type_name=='number':return float(value)
# 	if type_name=='string':return str(value)
if len(ports)>0 and (PropertyID is not None and ElementsID is not None and SetValue is not None):
	_elements = api.unpack(ElementsID)
	# _elements = api.unpack(ElementsID)['elements']
	property_value = api.getPropertyValue(_elements,[PropertyID],port)
	
	types = [t['type'] for t in property_value]
	new_values = api.unpack(SetValue)
	# new_values = api.unpack(SetValue)['values']
	# todo: recognize type !!
	types_values = zip(new_values,types)



	
	for i in range(len(new_values)):
		property_value[i]['value'] = api.convert_types(new_values[i],types[i])
		property_value[i]['type'] =  types[i]
		# property_value[i]['value'] =  new_values[i]
	
	# print property_value
	
	if run:
		printToPanel = api.setPropertyValue(_elements,PropertyID,property_value,port)
	else:
		printToPanel = 'GH scheme is globally turned off. Use Input <RunGlobally> in PickPort Node'
else: 
	printToPanel = '''
INPUT:
	PropertyID : string
	ElementsID : list
OUTPUT:
	printToPanel: message
	'''
# ---------- end setpropertyvalue ----------
panel_27 = Panel(serialize_list)

# ----
# Connection Port
boolean_toggle = BooleanToggle(False)

pickport = PickConnectionPort(Synchronise=boolean_toggle, pickPort=0, RunGlobally=1)  # -> printToPanel; inputs Synchronise: Boolean, pickPort: Int32, RunGlobally: Boolean
# ---------- pickport: Python ----------
ghenv.Component.Name = 'Pick connection port'
ghenv.Component.NickName = 'PickPort'
ghenv.Component.Message = '0.2'
ghenv.Component.Category = 'ARCHICAD'
ghenv.Component.SubCategory = 'API3'
ghenv.Component.Description = '''
Checks avaliable connection ports and dallows to pick one or all
INPUT:
	Synchronise  : bool Checks avaliable ports. 
						For performance reason should be set to false after first run
	pickPort     : int  Connect Integer type <Number Node> 
	RunGlobally  : bool Turns on/off global variable on which depends  other nodes performance.   
OUTPUT:
	printToPanel : string Message
'''
# ghenv.Component.AdditionalHelpFromDocStrings = '1'



import api2 as api
# reload(api)
printToPanel = Synchronise
api.set_global_toggle(RunGlobally)
p=None
ports = []

if Synchronise == True:

    ports = api.open_ports()
    
    p = api.get_port()

    projectNames = []
    _command = api.composeAddonCommand('GetProjectInfo')
    print _command
    for port in p:
        r = api.connect(_command,port)
        if r['succeeded']:
            _prjName = r['result']['addOnCommandResponse']['projectName']
            projectNames.append(_prjName)

    # if len(p)>1:
    #     p =  p + [p]

if p and pickPort is not None:
    wrapped_pickPort = api.get_wrapped_value(pickPort,projectNames)
    printToPanel = api.show_menu('Avaliable ports',projectNames,wrapped_pickPort)
    api.set_active_port(p[wrapped_pickPort])
else:
    printToPanel = 'Plug Boolean Toggle node to Synchronise Input\nand Number Slider to pickPort Input'
# ---------- end pickport ----------

panel_28 = Panel(pickport)

# ==== cluster SerializeList: Serialize list into string
list = ClusterInput()
valuesseries = Text(list)
text_join = TextJoin(ValuesSeries=valuesseries, Join=";")
packvalues = PackValues(Series=text_join, Delimiter=";")  # -> PackedValues
# ---------- packvalues: Python ----------
import api2 as api

if Series is not None:
    lista=[]
    lista = Series.split(Delimiter)
    PackedValues = api.packlist(lista)
# ---------- end packvalues ----------
serialized_list = ClusterOutput(packvalues)
