# Grasshopper definition tApir_BIMxx_done.gh (Grasshopper 1.0.7)

# 2 Generate Link to Layout
file_path = FilePath("/Users/GrzegorzWilk/Documents/Dropbox/bimx_db/tAPIr/tAPIr_demo.bimx")
# Save Layouts’ links to CSV
file_path_2 = FilePath("/Users/GrzegorzWilk/Documents/Dropbox/bimx_db/tAPIr/lilnks_to_layouts.csv")
panel = Panel("https://www.dropbox.com/s/cf4fyzzyjwekbqk/tapir_extension.bimxx?dl=0")
hyperlinktolayout = HyperlinkToLayout(BIMxFile=file_path, PickLayout=Slider(2, range=0..2))  # -> Layouts, LayoutHyperlink; inputs PickLayout: Int32
# ---------- hyperlinktolayout: Python ----------
ghenv.Component.Name = 'Hyperlink To Layout'
ghenv.Component.NickName = 'HyperlinkToLayout'
ghenv.Component.Message = '0.1'
ghenv.Component.Category = 'ARCHICAD_API'
ghenv.Component.SubCategory = 'Bimx'
ghenv.Component.Description = '''Creates link to Layout embeded in BIMx file
'''

import json
import urllib
import api2
api2=reload(api2)



if BIMxFile is not None:
    xmlData = api2.extract_xml_from_bimx(BIMxFile)
    # print xmlData 
    viewsInBIMx = api2.parseXML(xmlData)
    itemsAndFolders = viewsInBIMx.findall('HyperDocument')
    # print itemsAndFolders
    items = []
    
    layoutID= []
    layoutName =[]
    itemType =[]
    hypermodelName =  viewsInBIMx.find("HyperModel").text

    # def addItem(array,item):
    #     array.append(item)
        
    # def openFolder(array,folder):
    #     for f in folder:
    #         if f.tag=='Item':addItem(array,f)
    #         if f.tag=='Folder':openFolder(array,f)

    # def getLayouts(itemsAndFolders):
    #     _layoutName = []
    #     _layoutID   = []
    #     _items= []
    #     for j,i in enumerate(itemsAndFolders[0]):
    #         if i.attrib.has_key('type') == False:
    #             if i.tag=='Item':addItem(_items,i)
    #             if i.tag=='Folder':openFolder(_items,i)
    #     for item in _items:
            
    #         _layoutName.append(item.attrib['title'])
    #         _layoutID.append(item.attrib['id'])
    #     return _layoutName,_layoutID
    layoutName,layoutID = api2.getLayouts(itemsAndFolders)   
    
    wrapped_PickLayout = api2.get_wrapped_value(PickLayout,layoutName)
    
    Layouts = api2.show_menu(
        'LAYOUTS IN "{}" BIMx'.format(hypermodelName),
        layoutName,wrapped_PickLayout
        )

    LINK_BASE = 'bimxapplication://Show2dDocument?hypermodel={0}&layoutGuid={1}'.format(hypermodelName,layoutID[wrapped_PickLayout])
    LINK_BASE = LINK_BASE.replace(' ','%20')

    if HyperlinkName is None:
        LayoutHyperlink = LINK_BASE
    else:
        LayoutHyperlink = '[{0}]({1})'.format(HyperlinkName,LINK_BASE)
    # LayoutHyperlink = urllib.quote(LINK_BASE)
# ---------- end hyperlinktolayout ----------
# 4. Collect Elements
getelementsbytype = GetAllElementsByType(ElementType=Slider(3, range=0..10), SerializeElements=True)  # -> printToPanel, ElementsOfType; inputs ElementType: Int32, SerializeElements: Boolean
# ---------- getelementsbytype: Python ----------
ghenv.Component.Name = 'Get All elements by Type'
ghenv.Component.NickName = 'GetElementsByType'
ghenv.Component.Message = '0.1'
ghenv.Component.Category = 'ARCHICAD'
ghenv.Component.SubCategory = 'API3'
ghenv.Component.Description = '''
Collects GUIDS of all elements in a project by thier type
INPUT:
	ElementType  : int Choose type. Connect Number slider from 0 to 17
				
OUTPUT:
	printToPanel 	: string - Display list of all types. 
	ElementsOfType 	: dict - Elements packed to dictionary
'''

import api2 as p
reload(p)

ports = p.get_active_port()

el_types = p.getElementsTypes()

if ElementType is not None and isinstance(ElementType,int):
	wrapped_ElementType = p.get_wrapped_value(ElementType,el_types)

	printToPanel = p.show_menu('Element Types',el_types,wrapped_ElementType)

	choosen_type = el_types[wrapped_ElementType]


	_ElementsOfType=[]
	for port in ports:
		elem = p.getElementsByType(choosen_type,port)
		elem = p.unpack(elem)['elements']
		_ElementsOfType+=elem
	if SerializeElements:   
		ElementsOfType = p.packlist(_ElementsOfType)
	else:
		ElementsOfType = _ElementsOfType

	# ElementsOfType = p.pack('elements',_ElementsOfType)
else:
	printToPanel = 'CAUTION:\nConnect Number Slider to <ElementType> Input'
# ---------- end getelementsbytype ----------
# 1. Configure Extension
button = Button()
bakehyperlinkstolayouts = BakeHyperlinksToLayouts(BIMxFile=file_path, CSVFile=file_path_2, BakeHyperlinks=Button())  # inputs BakeHyperlinks: Int32
# ---------- bakehyperlinkstolayouts: Python ----------
ghenv.Component.Name = 'Bake Hyperlinks To Layouts'
ghenv.Component.NickName = 'BakeHyperlinksToLayouts'
ghenv.Component.Message = '0.1'
ghenv.Component.Category = 'ARCHICAD_API'
ghenv.Component.SubCategory = 'Bimx'
ghenv.Component.Description = '''Creates link to Layout embeded in BIMx file
'''

import json
import urllib
import api2
import csv
api2=reload(api2)



if BIMxFile is not None and CSVFile is not None:
    xmlData = api2.extract_xml_from_bimx(BIMxFile)
    root = api2.parseXML(xmlData)
    itemsAndFolders = root.findall('HyperDocument')
    _hyperModelName = root.find("HyperModel").text
    _hyperModelName = _hyperModelName.replace(' ', '%20')

    layoutName,layoutID = api2.getLayouts(itemsAndFolders) 

   
    views=[]
    views.append(['HYPERMODEL NAME',_hyperModelName])
    views.append(['LAYOUT NAME','HYPERLINK TO LAYOUT'])
    LINK_BASE = 'bimxapplication://Show2dDocument?hypermodel={0}&layoutGuid={1}'
    for i,j in enumerate(layoutName):
        views.append([layoutName[i],LINK_BASE.format(_hyperModelName,layoutID[i])])
    
    if BakeHyperlinks:

        with open(CSVFile,'w') as file:
            writer = csv.writer(file)
            for row in views:
                writer.writerow(row)
            file.close()
# ---------- end bakehyperlinkstolayouts ----------
file_path_3 = FilePath("/Users/GrzegorzWilk/Documents/Dropbox/bimx_db/tAPIr/tapir_extension.bimxx")
panel_2 = Panel(hyperlinktolayout.Layouts)
panel_3 = Panel(hyperlinktolayout.LayoutHyperlink)
panel_4 = Panel(getelementsbytype.printToPanel)
panel_5 = Panel(getelementsbytype.ElementsOfType)
elementcontext_position = ElementContext_Position({"Left": "left", "Right": "right"}, selected="Left")
elementcontext_style = ElementContext_Style({"Modal": "modal", "Browser": "browser", "Popover": "popover"}, selected="Popover")
# 5. Show only for certain elements
shownonlyif = ShownOnlyIf(element_guids=panel_5)  # -> shownOnlyIf
# ---------- shownonlyif: Python ----------
ghenv.Component.Name = 'Shown Only If'
ghenv.Component.NickName = 'ShownOnlyIf'
ghenv.Component.Message = '0.1'
ghenv.Component.Category = 'ARCHICAD_API'
ghenv.Component.SubCategory = 'Bimx'
ghenv.Component.Description = '''
'''
import json
_shownOnlyIf = {}
if element_guids is not None:
    _element_guids = json.loads(element_guids)
    _shownOnlyIf['element_guids'] = _element_guids
    # shownOnlyIf = json.dumps(_shownOnlyIf) 

_metadata ={}
if isPresent is not None:
    _isPresent = json.loads(isPresent)
    _metadata['is_present'] = _isPresent
    # _shownOnlyIf['metadata'] = _metadata
    # shownOnlyIf = json.dumps(_shownOnlyIf) 

if PropertyName is not None and PropertyValue is not None:
    _propertyNames = json.loads(PropertyName)
    _propertyValues = json.loads(PropertyValue)
    _equals = []
    for i in range(
                min(
                    len(_propertyNames),len(_propertyValues)
                )
            ):
        _equals.append(
                {
                'key':_propertyNames[i],
                'value':_propertyValues[i],
                }
            )
    _metadata['equals'] = _equals

if (PropertyName is not None and PropertyValue is not None) or isPresent is not None:
    _shownOnlyIf['metadata'] = _metadata
shownOnlyIf = json.dumps(_shownOnlyIf)
# ---------- end shownonlyif ----------
# 3. Create Context Menu
contextmenu = ContextMenu(Title="Window Spec", URL=panel_3, Style=elementcontext_style, Position=elementcontext_position, shownOnlyIf=shownonlyif)  # -> Elem_context_menu
# ---------- contextmenu: Python ----------
ghenv.Component.Name = 'Context menu'
ghenv.Component.NickName = 'Contextmenu'
ghenv.Component.Message = '0.1'
ghenv.Component.Category = 'ARCHICAD_API'
ghenv.Component.SubCategory = 'Bimx'
ghenv.Component.Description = '''
'''

import json
if Title is not None and URL is not None and Style is not None and Position is not None:
    _elem = {
        'title':Title,
        'url':URL,
        'style': Style,
        'position':Position

    }
    if shownOnlyIf is not None:
        _shownOnlyIf = json.loads(shownOnlyIf)
        _elem['shown_only_if']=_shownOnlyIf
    j = json.dumps(_elem,indent=4)
    Elem_context_menu = j
else:
    print 'Connect all Inputs!!'
# ---------- end contextmenu ----------
# Bake Extension
createextension = CreateExtension(
    BimxxFile=file_path_3,
    BakeBimxxFile=button,
    EncryptExtension=0,
    UpdateUrl=panel,
    ExtensionName="tAPIr Extension",
    ElementContextMenu=contextmenu)  # inputs BakeBimxxFile: Boolean, EncryptExtension: Boolean
# ---------- createextension: Python ----------
ghenv.Component.Name = 'Create Extension'
ghenv.Component.NickName = 'CreateExtension'
ghenv.Component.Message = '0.1'
ghenv.Component.Category = 'ARCHICAD_API'
ghenv.Component.SubCategory = 'Bimx'
ghenv.Component.Description = '''
'''
import json
from bimx_encoder import  encoder as e 
e=reload(e)
import datetime
now = str(datetime.datetime.now())

bimxx={}
if  BimxxFile is not None and\
    BakeBimxxFile is not None:


    # ProjectInfo is not None and\
    # ElementContextMenu is not None:
    if ExtensionName:bimxx['name'] = ExtensionName#+now 
    if devID:
        bimxx['developer_id'] = devID
    else:
        bimxx['developer_id'] = '8ad9b618-3206-4f60-b7df-24f97986aa65' 
    if UpdateUrl:bimxx['update_url'] = UpdateUrl+'&raw=1'

    if HyperModelNames is not None:
        _hypermodelnames = json.loads(HyperModelNames)
        if isinstance(_hypermodelnames,dict):
            _hypermodelnames = [_hypermodelnames]
        bimxx['hyper_model_names'] = _hypermodelnames#[context_01]
    # bimxx['hyper_model_names'] = ["prj_bimx","WALLS"]

    url_var = [
    '$(hyper_model_name)',
    '$(project_id)',
    '$(project_name)',
    '$(first_measure_point)',
    '$(camera_pos)',
    '$(view_direction)'
    ]
    if ElementContextMenu is not None:
        context = json.loads(ElementContextMenu)
        # print context
        if isinstance(context,dict):
            context = [context]
        bimxx['elem_context_menu'] = context#[context_01]
    #-------------------
    prj_info =  {}
    if ProjectInfo is not None:
        _proj = json.loads(ProjectInfo)#[prj_info]
        if isinstance(_proj,dict):
            _proj = [_proj]
        bimxx['project_info'] = _proj

    if ElementInfo is not None:
        _proj = json.loads(ElementInfo)#[prj_info]
        #if isinstance(_proj,dict):
         #   _proj = [_proj]
        bimxx['elem_info'] = _proj
        
    if ModelInfo is not None:
        _proj = json.loads(ModelInfo)#[prj_info]
        #if isinstance(_proj,dict):
         #   _proj = [_proj]
        bimxx['model_info'] = _proj

    c = json.dumps(bimxx,indent=4)
    print c

    if BakeBimxxFile:
        with open(BimxxFile,'w') as f:
            f.write(c)
#        if EncryptExtension:
#            print 'Extension encrypted'
#            encoder = e.encoder_path()
#            e.encrypt(BimxxFile,encoder,overwrite=True)
#   Feature not implemented yet. Require bimxx encoder that can be found here
#   https://graphisoft.sharefile.com/d-s13ee1be5fc4d44caa108bd81d3c7196f
#   Input parameter name (type bool) <EncryptExtension>

else:
    print 'Connect all Inputs!!'
# ---------- end createextension ----------
