# Grasshopper definition test tapir.gh (Grasshopper 1.0.8)
# plug-ins: RhinoCodePluginGH, tAPIr, MetaHopper, TapirGrasshopperPlugin

# ---- group: Tpl
plugins_used = Panel("RhinoCodePluginGH ")
timer = Timer(Interval=900000, TimerInterval=900000, Target=o_getcomps2)  # disabled
o_getcomps2 = OTools_GetComponents2(x=Button())  # inputs x: Boolean; plug-in component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

# ---- group: Colors
_3 = ColourSwatch(SwatchColor=RGB(112, 255, 198))
_4 = ColourSwatch(SwatchColor=RGB(253, 255, 201))
_6 = ColourSwatch(SwatchColor=RGB(214, 175, 154))
_7 = ColourSwatch(SwatchColor=RGB(227, 123, 163))
_0 = ColourSwatch(SwatchColor=RGB(64, 64, 64))
_1 = ColourSwatch(SwatchColor=RGB(209, 149, 71))
_2 = ColourSwatch(SwatchColor=RGB(242, 170, 170))
_5 = ColourSwatch(SwatchColor=RGB(35, 84, 219))
_8 = ColourSwatch(SwatchColor=RGB(255, 0, 98))
_9 = ColourSwatch(SwatchColor=RGB(255, 0, 98))
panel = Panel("""Parameters
Process
Analysis
Output
Bake
Display
Archicad
Speckle
Annotation
Test""")
merge = Merge(Data1=_0, Data2=_1, Data3=_2, Data4=_3, Data5=_4, Data6=_5, Data7=_6, Data8=_7, Data9=_8, Data10=_9)
gh_canvas_style = GHCanvasStyle(
    panel_default_color=ColourSwatch(SwatchColor=RGB(255, 255, 255)),
    canvas_background_color=ColourSwatch(SwatchColor=RGB(222, 220, 220)),
    canvas_gridline_color=ColourSwatch(SwatchColor=RGB(224, 175, 175)))  # -> out
# ---------- gh_canvas_style: Python ----------
import Grasshopper
import rhinoscriptsyntax as rs

if panel_default_color == None:
    panel_default_color = rs.CreateColor(255,250,90)
if canvas_background_color == None:
    canvas_background_color = rs.CreateColor(212,208,200)
if canvas_gridline_color == None:
    canvas_gridline_color = rs.CreateColor(0,0,0,30)

Grasshopper.GUI.Canvas.GH_Skin.panel_back = panel_default_color
Grasshopper.GUI.Canvas.GH_Skin.canvas_back = canvas_background_color
Grasshopper.GUI.Canvas.GH_Skin.canvas_grid = canvas_gridline_color

print "Cool Choices! I like your style"


ghenv.Component.Name = "GH Canvas Style"
ghenv.Component.NickName = 'GH Canvas Style'
ghenv.Component.Message = 'Love your style!'
# ---------- end gh_canvas_style ----------
default_color = ColourSwatch(SwatchColor=RGB(214, 206, 206))
timer_2 = Timer(Interval=2000, TimerInterval=2000, Target=group_colours)
panel_2 = Panel(gh_canvas_style)
group_colours = GroupColours(group_names=panel, colors=merge, default_color=default_color)  # -> out; inputs group_names: list, colors: list
# ---------- group_colours: Python ----------
import Grasshopper

doc = ghenv.Component.Attributes.Owner.OnPingDocument()
for i in doc.Objects:
    if str(type(i)) == "<type 'GH_Group'>":
        name_of_current_group = i.NickName.ToString()
        if name_of_current_group in group_names:
            index = group_names.index(name_of_current_group)
            color = colors[index]
            i.Colour = color
        else:
            i.Colour = default_color
print "No Problemo"

ghenv.Component.Name = "Group Colours"
ghenv.Component.NickName = 'Group Colours'
ghenv.Component.Message = 'Make sure your *inputs match*'
# ---------- end group_colours ----------
panel_3 = Panel(group_colours)

# ----
update = Update()
connect = Connect(Refresh=update)
panel_4 = Panel(connect)

tapirversion = GetTapirAddOnVersion()
panel_5 = Panel(tapirversion)

archicadlocation = GetArchicadLocation()
panel_6 = Panel(archicadlocation)

elemsbytype = GetElementsByType(Type="Slab")
panel_7 = Panel(elemsbytype)

selectedelems = GetSelectedElements()
panel_8 = Panel(selectedelems)

projectinfo = GetProjectInformation()  # -> IsUntitled, IsTeamwork, ProjectLocation, ProjectPath, ProjectName
panel_9 = Panel(projectinfo.IsUntitled)
panel_10 = Panel(projectinfo.ProjectLocation)
panel_11 = Panel(projectinfo.ProjectName)

getproperties = GetAllProperties()
findproperty = FindProperty(PropertyDetails=getproperties, GroupName="EnzymeCustom", PropertyName="Custom Name")

panel_12 = Panel(getproperties)

lng = ListLength(List=getproperties)
panel_13 = Panel(lng)

lng_2 = ListLength(List=panel_7)
panel_14 = Panel(lng_2)
series = Series(Start=0, Step=1, Count=panel_14)
format = Format(Format="{0:000}", Culture=127, Data0=series)
concat = Concatenate(FragmentA="CustomName", FragmentC="-", FragmentB=format)

setpropertyvalues = SetPropertyValuesOfElements(PropertyId=findproperty, ElementIds=elemsbytype, Values=concat)

split = TextSplit(Text=getproperties, Separators=";")
item = ListItem(List=split, Index=0, Wrap=True)  # -> Item, Item1, Item2

# ---- group: FIND TEXT: CULL PATTERN
tmatch = MatchText(Text=panel_12, RegEx="EnzymeCustom", Case=True)
panel_15 = Panel(tmatch)
ma = MassAddition(Input=flatten(tmatch))  # -> Result, PartialResults
test = Panel(ma.Result)

tmatch_2 = MatchText(Text=flatten(panel_12), RegEx="EnzymeCustom", Case=True)
panel_16 = Panel(tmatch_2)
ma_2 = MassAddition(Input=flatten(tmatch_2))  # -> Result, PartialResults
panel_17 = Panel(ma_2.Result)

# ----
merge_2 = Merge(Data1=item.Item, Data2=item.Item1, Data3=item.Item2)
cull = CullPattern(List=merge_2, CullPattern=graft(panel_16))
toggle = BooleanToggle(True)
clean = CleanTree(RemoveNulls=toggle, RemoveInvalid=toggle, RemoveEmpty=toggle, Tree=cull)

cset = CreateSet(List=flatten(item.Item1))  # -> Set, Map
panel_18 = Panel(cset.Set)

item_2 = ListItem(List=clean, Index=0, Wrap=True)  # -> Item, Item1, Item2
concat_2 = Concatenate(FragmentA=item_2.Item, FragmentB=item_2.Item1, FragmentC=item_2.Item2, JoinSeparator=";")  # -> flatten(Result)

panel_19 = Panel(clean)
# {0}
# 0. E849B9D2-9EEB-5541-BC07-024760A83D51; EnzymeCustom; Original Favorite Name
# 1. 51A5507F-B90C-FA41-8AD9-D0B051AD1A81; EnzymeCustom; Description (auto)
# 2. 412E6483-9B29-044A-9DB4-57A965D1E2F1; EnzymeCustom; Custom Name
# 3. 9EB7D4CA-7CED-1244-93E6-47016C4F3639; EnzymeCustom; Scheduled?
# 4. D29AA22F-8961-244E-A0A2-ECF5370F5435; EnzymeCustom; Scope
# 5. D80C1EA8-580F-6248-AFA5-73715E0779F9; EnzymeCustom; ZoneCategory_QA
# 6. 41A0CE46-E77F-5A44-8396-D1BD5A162037; EnzymeCustom; ZoneCategory_QA2
# 7. 413CD506-2967-234C-BECB-D80148B4BA12; EnzymeCustom; ZoneCategory_Colour (manual)
# 8. 73FCEF51-EF96-4247-809B-7773C4E50F7C; EnzymeCustom; ZoneCategory_Colour
# 9. 9B34887A-C261-9541-8590-9433C8AE6ECE; EnzymeCustom; ZoneCategory
# 10. 940BDB76-3F10-5949-A78C-A5E06374AD2C; EnzymeCustom; ZoneArea
# 11. 4BC38F8D-C2D6-0145-925A-62E4A47F1AF5; EnzymeCustom; ZoneCategoryType
panel_20 = Panel(concat_2)

lng_3 = ListLength(List=concat_2)
panel_21 = Panel(lng_3)

cull_2 = CullPattern(List=panel_12, CullPattern=panel_15)

# ---- group: FIND TEXT: CULL PATTERN
tmatch_3 = MatchText(Text=cull_2, RegEx="(manual)", Case=True)
panel_22 = Panel(tmatch_3)
ma_3 = MassAddition(Input=flatten(tmatch_3))  # -> Result, PartialResults
test_2 = Panel(ma_3.Result)

# ----
expression = Expression(x=ma_3.Result, Expression="If(x<0, \"red\", \"Cyan\")")
setpanel = SetPanelProperties(Panel=[null x2], NickName="test", Color=expression, AllObjects_Object=[test, test_2])

cull_3 = CullPattern(List=cull_2, CullPattern=panel_22)
panel_23 = Panel(cull_3)
