# Grasshopper definition Tapir utility Nodes Explanation.gh (Grasshopper 1.0.8)
# plug-ins: Tapir, ShapeDiverForGrasshopper, eleFront

# ---- group: Tpl
plugins_used = Panel("RhinoCodePluginGH ")
timer = Timer(Interval=900000, TimerInterval=900000, Target=o_getcomps2)  # disabled
o_getcomps2 = OTools_GetComponents2(x=Button())  # inputs x: Boolean; plug-in component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

# ---- group: Colors
_3 = ColourSwatch(SwatchColor=RGB(112, 255, 198))
_4 = ColourSwatch(SwatchColor=RGB(253, 255, 201))
_6 = ColourSwatch(SwatchColor=RGB(214, 175, 154))
_7 = ColourSwatch(SwatchColor=RGB(227, 123, 163))
_0 = ColourSwatch(SwatchColor=RGB(64, 64, 64))
_1 = ColourSwatch(SwatchColor=RGB(209, 149, 71))
_2 = ColourSwatch(SwatchColor=RGB(242, 170, 170))
_5 = ColourSwatch(SwatchColor=RGB(35, 84, 219))
_8 = ColourSwatch(SwatchColor=RGB(255, 0, 98))
_9 = ColourSwatch(SwatchColor=RGB(255, 0, 98))
panel = Panel("""Parameters
Process
Analysis
Output
Bake
Display
Archicad
Speckle
Annotation
Test""")
merge = Merge(Data1=_0, Data2=_1, Data3=_2, Data4=_3, Data5=_4, Data6=_5, Data7=_6, Data8=_7, Data9=_8, Data10=_9)
gh_canvas_style = GHCanvasStyle(
    panel_default_color=ColourSwatch(SwatchColor=RGB(255, 255, 255)),
    canvas_background_color=ColourSwatch(SwatchColor=RGB(222, 220, 220)),
    canvas_gridline_color=ColourSwatch(SwatchColor=RGB(224, 175, 175)))  # -> out
# ---------- gh_canvas_style: Python ----------
import Grasshopper
import rhinoscriptsyntax as rs

if panel_default_color == None:
    panel_default_color = rs.CreateColor(255,250,90)
if canvas_background_color == None:
    canvas_background_color = rs.CreateColor(212,208,200)
if canvas_gridline_color == None:
    canvas_gridline_color = rs.CreateColor(0,0,0,30)

Grasshopper.GUI.Canvas.GH_Skin.panel_back = panel_default_color
Grasshopper.GUI.Canvas.GH_Skin.canvas_back = canvas_background_color
Grasshopper.GUI.Canvas.GH_Skin.canvas_grid = canvas_gridline_color

print "Cool Choices! I like your style"


ghenv.Component.Name = "GH Canvas Style"
ghenv.Component.NickName = 'GH Canvas Style'
ghenv.Component.Message = 'Love your style!'
# ---------- end gh_canvas_style ----------
default_color = ColourSwatch(SwatchColor=RGB(214, 206, 206))
timer_2 = Timer(Interval=2000, TimerInterval=2000, Target=group_colours)
panel_2 = Panel(gh_canvas_style)
group_colours = GroupColours(group_names=panel, colors=merge, default_color=default_color)  # -> out; inputs group_names: list, colors: list
# ---------- group_colours: Python ----------
import Grasshopper

doc = ghenv.Component.Attributes.Owner.OnPingDocument()
for i in doc.Objects:
    if str(type(i)) == "<type 'GH_Group'>":
        name_of_current_group = i.NickName.ToString()
        if name_of_current_group in group_names:
            index = group_names.index(name_of_current_group)
            color = colors[index]
            i.Colour = color
        else:
            i.Colour = default_color
print "No Problemo"

ghenv.Component.Name = "Group Colours"
ghenv.Component.NickName = 'Group Colours'
ghenv.Component.Message = 'Make sure your *inputs match*'
# ---------- end group_colours ----------
panel_3 = Panel(group_colours)

# ----
sddp = ShapeDiverDocumentPayload({AbsoluteTolerance=0, AngleTolerance=0, DistanceDisplayPrecision=0, GltfVersion="Gltf2", GrasshopperVersion="1.0.0008", InputGroups="{}", OutputGroups="{}", RelativeTolerance=0, RhinoVersion="8.18.25100.11002", UnitSystem=0, VersionCreated="1.18.1.0", VersionSaved="1.18.1.0"})  # disabled
brep = Brep([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])  # disabled
number_slider = Slider(5, range=0..10)  # disabled
number_slider_2 = Slider(5, range=0..10)  # disabled
brep_2 = Brep([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])  # disabled
brep_3 = Brep([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])  # disabled
brep_4 = Brep([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])  # disabled
# PYTHON NODES
brep_5 = Brep([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])  # disabled
panel_4 = Panel("3")  # disabled
panel_5 = Panel("3")  # disabled
volume = Volume(Geometry=brep)  # -> Volume, Centroid; disabled
panel_6 = Panel("""a word
this is a sentence
this is a key to search
This is a fourth line
another line with
keynote""")  # disabled
pt = Point(volume.Centroid)  # disabled
entwine = Entwine(Branch00=brep_5, Branch01=brep_3, Branch02=brep_2, Branch03=brep_4, FlattenInputs=True)  # disabled
crv = Curve(graft([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]))  # disabled
brep_6 = Brep([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])  # disabled
brep_7 = Brep([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])  # disabled
brep_8 = Brep([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])  # disabled
brep_9 = Brep([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])  # disabled
brep_10 = Brep([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])  # disabled
brep_11 = Brep([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])  # disabled
number_slider_3 = Slider(3, range=0..10)  # disabled
series = Series(Start=0, Step=1, Count=number_slider)  # disabled
pdecon = Deconstruct(Point=pt)  # -> XComponent, YComponent, ZComponent; disabled
series_2 = Series(Start=panel_4, Step=panel_5, Count=number_slider_2)  # disabled
brep_12 = Brep([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])  # disabled
number_slider_4 = Slider(234, range=0..1000)  # disabled
querymode = QueryMode({"greater", "smaller", "equals", "closest", "group_equals", "group_unique"}, selected="smaller")  # disabled
colormode = ColorModeValList({"gradient", "random", "complementary"}, selected="gradient")  # disabled
volume_2 = Volume(Geometry=brep_10)  # -> Volume, Centroid; disabled
end = EndPoints(Curve=crv)  # -> Start, End; disabled
entwine_2 = Entwine(Branch00=brep_11, Branch01=brep_8, Branch02=brep_6, Branch03=brep_9, FlattenInputs=True)  # disabled
volume_3 = Volume(Geometry=brep_7)  # -> Volume, Centroid; disabled
panel_7 = Panel(series)  # disabled
panel_8 = Panel(series_2)  # disabled
addition = Addition(A=pdecon.XComponent, B=pdecon.YComponent)  # disabled
toggle = BooleanToggle(False)  # disabled
toggle_2 = BooleanToggle(False)  # disabled
toggle_3 = BooleanToggle(True)  # disabled
panel_9 = Panel("Key")  # disabled
swatch = ColourSwatch(SwatchColor=RGB(204, 255, 94))  # disabled
swatch_2 = ColourSwatch(SwatchColor=RGB(255, 0, 255))  # disabled
panel_10 = Panel("41.5")  # disabled
pdecon_2 = Deconstruct(Point=volume_3.Centroid)  # -> XComponent, YComponent, ZComponent; disabled
start = EleFrontDataDescription(end.Start, ShiftDepth=0, isNameSet=False)  # disabled
end_2 = EleFrontDataDescription(end.End, ShiftDepth=0, isNameSet=False)  # disabled
number_slider_5 = Slider(3, range=0..10)  # disabled
button = Button()  # disabled
grouptree = GroupToTree(data_list=brep, values_list=addition)  # -> out, output_tree, unique_values; inputs data_list: list, values_list: list; disabled
# ---------- grouptree: Python ----------
from Grasshopper import DataTree
from Grasshopper.Kernel.Data import GH_Path
import Rhino.Geometry as rg  # Import Rhino Geometry for potential conversions

# Input validation
if not data_list or not values_list:
    message = "Error: Both data list and values list are required"
    print(message)
    output_tree = DataTree[object]()  # Empty tree for error case
    unique_values = []
    branch_counts = []
else:
    # Convert inputs to lists if they're not already, but preserve their types
    data_list = list(data_list)  # This should preserve Rhino geometry and other objects
    values_list = list(values_list)
    
    # Validate lists have same length
    if len(data_list) != len(values_list):
        message = f"Error: Lists have different lengths. Data: {len(data_list)}, Values: {len(values_list)}"
        print(message)
        output_tree = DataTree[object]()  # Empty tree for error case
        unique_values = []
        branch_counts = []
    else:
        try:
            # Create dictionary to store unique values and their data
            groups = {}
            
            # Group data by values, attempting to handle geometry if needed
            for item, val in zip(data_list, values_list):
                if val not in groups:
                    groups[val] = []
                # Check if item is text and try to convert to geometry if possible
                if isinstance(item, str):
                    try:
                        # Attempt to convert text to geometry (e.g., points or curves)
                        if item.startswith("Point"):  # Example for Point3d
                            parts = item.replace("Point", "").strip("()").split(",")
                            item = rg.Point3d(float(parts[0]), float(parts[1]), float(parts[2]))
                        # Add more conversion cases as needed (e.g., for curves, surfaces)
                    except Exception:
                        pass  # If conversion fails, keep as text
                groups[val].append(item)  # Append original or converted item
            
            # Create data tree to hold original or converted data types
            output_tree = DataTree[object]()
            
            # Sort groups by values and create unique values list
            sorted_items = sorted(groups.items())
            unique_values = [value for value, _ in sorted_items]
            branch_counts = [len(items) for _, items in sorted_items]
            
            # Add branches to tree, preserving original or converted data
            for i, (value, items) in enumerate(sorted_items):
                path = GH_Path(i)
                output_tree.AddRange(items, path)  # Add original or converted items to the tree
            
            # Format message
            message = f"Created {len(groups)} branches from {len(data_list)} items\n"
            message += "Items per branch: \n"
            
            # Format items per branch with wrapping
            items_message = ', '.join(f'{v}({c})' for v, c in zip(unique_values, branch_counts))
            max_line_length = 40
            current_line = ""
            
            for item in items_message.split(', '):
                if len(current_line) + len(item) + 2 <= max_line_length:  # +2 for ", "
                    current_line += item + ", "
                else:
                    message += current_line.rstrip(", ") + "\n"
                    current_line = item + ", "
            
            # Add the last line
            if current_line:
                message += current_line.rstrip(", ")
            
            print(message)
            
        except Exception as e:
            message = f"Error: {str(e)}"
            print(message)
            output_tree = DataTree[object]()  # Empty tree for error case
            unique_values = []
            branch_counts = []

# Update component properties
ghenv.Component.Name = "Group to Tree"
ghenv.Component.NickName = 'GroupTree'
ghenv.Component.Message = message
# ---------- end grouptree ----------
filter_contains = FilterContainsString(strings_list=panel_6, search_str=panel_9, case_sensitive=toggle, whole_words=toggle_2)  # -> out, filtered_list, filtered_indices, count, pattern; inputs strings_list: list of String, search_str: list of String, case_sensitive: Boolean; disabled
# ---------- filter_contains: Python ----------
import Grasshopper as gh
import re

# INPUTS:
# - strings_list: List of strings (required)
#   A list of strings to search through. Must be provided; empty or None will trigger an error message.
# - search_str: String (required)
#   The string to search for within the strings_list. Can be a single string or a list (first item used).
#   Empty or None will trigger an error message.
# - case_sensitive: Boolean (optional)
#   Determines if the search is case-sensitive. Defaults to False if unconnected.
#   Set to True for case-sensitive matching (e.g., "Test" ≠ "test").
# - whole_words: Boolean (optional)
#   Determines if the search matches whole words only. Defaults to True if unconnected.
#   Set to True to match only whole words (e.g., "word" matches "word" but not "sword").
#   Set to False for partial matches (e.g., "word" matches "sword").

# Default settings (can be added as inputs to the component)
if 'case_sensitive' not in globals() or case_sensitive is None:
    case_sensitive = False  # Set to True for case-sensitive search
if 'whole_words' not in globals() or whole_words is None:
    whole_words = True    # Set to True to match only whole words

# Initialize outputs
filtered_list = []
filtered_indices = []
count = 0
message = "Waiting for input strings."
pattern = []  # New output: Boolean pattern

# Set component UI
ghenv.Component.Name = "Filter Contains String"
ghenv.Component.NickName = "Filter Contains"
ghenv.Component.Message = message

def wrap_text(text, width=40):
    """Wrap text to specified width, preserving words and existing newlines"""
    # Split into lines based on existing newlines first
    lines = text.split('\n')
    wrapped_lines = []
    
    for line in lines:
        words = line.split()
        current_line = []
        current_length = 0
        
        for word in words:
            if current_length + len(word) + 1 <= width:  # +1 for space
                current_line.append(word)
                current_length += len(word) + 1
            else:
                if current_line:  # Add current line if it exists
                    wrapped_lines.append(' '.join(current_line))
                current_line = [word]
                current_length = len(word)
        
        if current_line:  # Add the last line
            wrapped_lines.append(' '.join(current_line))
    
    return '\n'.join(wrapped_lines)

# Input validation
if strings_list is None or not strings_list or search_str is None or search_str == "":
    message = wrap_text("Error: Provide both a strings list and a search string.")
    print(message)
else:
    # Ensure search_str is a string
    search_str = str(search_str[0]) if isinstance(search_str, list) else str(search_str)
    
    try:
        # Main Script - Store tuples of (index, string)
        if whole_words:
            pattern = r'\b' + re.escape(search_str) + r'\b'
            if not case_sensitive:
                pattern = re.compile(pattern, re.IGNORECASE)
            else:
                pattern = re.compile(pattern)
            filtered_with_indices = [(i, s) for i, s in enumerate(strings_list) if re.search(pattern, s)]
        else:
            if case_sensitive:
                filtered_with_indices = [(i, s) for i, s in enumerate(strings_list) if search_str in s]
            else:
                filtered_with_indices = [(i, s) for i, s in enumerate(strings_list) if search_str.lower() in s.lower()]
        
        # Unzip the filtered results into separate lists
        filtered_indices, filtered_list = zip(*filtered_with_indices) if filtered_with_indices else ([], [])
        
        filtered_indices = list(filtered_indices)
        filtered_list = list(filtered_list)
        
        # Generate boolean pattern
        pattern = [False] * len(strings_list)  # Initialize with False for all
        for idx in filtered_indices:
            pattern[idx] = True
        
        count = len(filtered_list)
        
        # Create message parts
        mode_whole_words = f"whole_words: {whole_words}"
        mode_case_sensitive = f"case_sensitive: {case_sensitive}"
        match_count = f"Number of matches: {count}"
        
        # Ensure three lines with explicit newlines
        message = f"{mode_whole_words}\n{mode_case_sensitive}\n{match_count}"
        message = wrap_text(message)  # Apply wrapping while preserving newlines
    
    except Exception as e:
        message = wrap_text(f"Error: {str(e)}")
        filtered_list = []
        filtered_indices = []
        count = 0
        pattern = []
        print(message)

# Update Grasshopper component message
ghenv.Component.Message = message
# ---------- end filter_contains ----------
mlfilter = MultiListFilter(list1=volume_2.Centroid, list2=brep_12, list3=panel_7, list4=panel_8, index=number_slider_5)  # -> out, out1, out2, out3, out4; inputs list1: list, list2: list, list3: list, list4: list; disabled
# ---------- mlfilter: Python ----------
import Grasshopper as gh
import System

# Set component UI
ghenv.Component.Name = "Multi-List Filter"
ghenv.Component.NickName = 'MLFilter'

# Default message
message = "Waiting for at least one input list."

# Collect input lists without modifying globals during iteration
input_keys = [key for key, value in globals().items() if key.startswith('list') and (isinstance(value, (list, tuple)) or value is None)]
input_lists = [globals()[key] for key in input_keys]

# Initialize outputs as empty lists
for i in range(4):  # Support up to 4 lists (list1 to list4)
    globals()[f'out{i+1}'] = []

# Process only if we have at least one non-None input list
non_none_lists = [lst for lst in input_lists if lst is not None]

if non_none_lists:
    # Convert input lists to regular lists
    input_lists = [list(lst) for lst in non_none_lists]
    
    # Validate lists have the same length
    lengths = [len(lst) for lst in input_lists]
    if not all(x == lengths[0] for x in lengths):
        # Format error message with line breaks
        message = f"Lists have different lengths:\n{lengths}"
        # Outputs already set to empty lists
    else:
        # Convert index to list for unified processing
        indices = [index] if not isinstance(index, list) else index
        indices = [int(i) if i >= 0 else lengths[0] + int(i) for i in indices]
        
        try:
            # Filter all lists using the indices
            filtered_lists = []
            for lst in input_lists:
                filtered = [lst[i] for i in indices]
                # If only one index was used, return single items instead of lists
                if len(indices) == 1:
                    filtered = filtered[0]
                filtered_lists.append(filtered)
            
            # Assign to output variables
            for i, filtered in enumerate(filtered_lists):
                globals()[f'out{i+1}'] = filtered
            
            # Format success message with line breaks
            if len(indices) == 1:
                message = f"Output: {len(indices)} value\nfrom {len(input_lists)} lists"
            else:
                message = f"Output: {len(indices)} values\nfrom {len(input_lists)} lists"
            
            # Add additional details if needed
            if len(message) < 40:
                message += f"\nof {lengths[0]} elements"
            
        except IndexError as e:
            # Format error message with line breaks
            message = f"Index out of range.\nValid range is -{lengths[0]} to {lengths[0]-1}"
            # Outputs already set to empty lists

# Ensure the message is properly formatted with line breaks
def format_message(msg, max_length=30):
    """Helper function to format the message with line breaks."""
    lines = []
    current_line = ""
    for word in msg.split():
        if len(current_line) + len(word) + 1 <= max_length:
            current_line += word + " "
        else:
            lines.append(current_line.strip())
            current_line = word + " "
    if current_line:
        lines.append(current_line.strip())
    return "\n".join(lines)

# Format the final message
ghenv.Component.Message = format_message(message)
# ---------- end mlfilter ----------
branchcolorgen = BranchColorGenerator(tree=entwine, mode=colormode, initColor=swatch, endColor=swatch_2, seed=number_slider_4, flatten=toggle_3)  # -> out, inputTree, colors; inputs tree: tree, initColor: Color, seed: Int32, flatten: Boolean; disabled
# ---------- branchcolorgen: Python ----------
import Grasshopper as gh
from Grasshopper import DataTree
from Grasshopper.Kernel.Data import GH_Path
import System
from System.Drawing import Color
import random
import colorsys

# Set component UI
ghenv.Component.Name = "Branch Color Generator"
ghenv.Component.NickName = "BranchColorGen"

# Default message
message = "Waiting for input DataTree."

# Initialize outputs
colors = DataTree[object]()
inputTree = DataTree[object]()

# INPUTS:
# - tree: DataTree[object] (required)
#   A Grasshopper DataTree with multiple branches. Each branch can contain any number of items
#   (e.g., colors, numbers, strings). The structure determines the output structure.
# - initColor: System.Drawing.Color or GH_Colour (optional)
#   The starting color for gradient or base color for complementary mode. Required for gradient
#   and complementary modes. Defaults to black if unconnected or invalid.
# - endColor: System.Drawing.Color or GH_Colour (optional)
#   The ending color for gradient mode. Ignored in complementary and random modes.
#   Defaults to white if unconnected or invalid.
# - seed: Integer (optional)
#   A seed value for random color generation. Used only in random mode. If unconnected,
#   random colors are non-reproducible.
# - flatten: Boolean (optional)
#   Determines whether outputs are flattened. If True, both colors and inputTree are flattened
#   into a single list at path {0}. If False, outputs retain the input tree's structure.
#   Defaults to False if unconnected.
# - mode: String or Integer (optional)
#   Selects the color generation mode. Accepts "gradient", "complementary", or "random" (case-insensitive),
#   or integers 0 (gradient), 1 (complementary), 2 (random). Defaults to "random" if unconnected.

# Default values
if 'flatten' not in globals() or flatten is None:
    flatten = False
if 'mode' not in globals() or mode is None:
    mode = "random"  # Default mode

# Function to generate a random color
def random_color(used_colors, seed=None):
    if seed is not None:
        random.seed(seed)  # Set the seed for reproducibility
    while True:
        r = random.randint(0, 255)
        g = random.randint(0, 255)
        b = random.randint(0, 255)
        color = Color.FromArgb(r, g, b)
        # Ensure the color is unique (or close enough)
        if color not in used_colors:
            return color

# Function to interpolate between two colors
def interpolate_color(start_color, end_color, t):
    r = int(start_color.R + (end_color.R - start_color.R) * t)
    g = int(start_color.G + (end_color.G - start_color.G) * t)
    b = int(start_color.B + (end_color.B - start_color.B) * t)
    return Color.FromArgb(r, g, b)

# Function to convert data to Grasshopper-compatible format
def convert_to_gh_compatible(item):
    if isinstance(item, (int, float)):
        return gh.Kernel.Types.GH_Number(item)
    elif isinstance(item, str):
        return gh.Kernel.Types.GH_String(item)
    elif isinstance(item, Color):
        return gh.Kernel.Types.GH_Colour(item)
    elif isinstance(item, gh.Kernel.Types.GH_Colour):
        return item  # Already a GH_Colour, no conversion needed
    return item  # Return as-is if no conversion is needed

# Function to normalize mode input
def get_mode(mode_input):
    if isinstance(mode_input, (int, float)):
        mode_map = {0: "gradient", 1: "complementary", 2: "random"}
        return mode_map.get(int(mode_input), "random")
    elif isinstance(mode_input, str):
        return mode_input.lower().strip() in ["gradient", "complementary", "random"] and mode_input.lower() or "random"
    return "random"

# Function to generate evenly distributed colors based on initColor
def get_distributed_colors(init_color, num_colors):
    if not isinstance(init_color, Color):
        init_color = Color.Black
    # Convert initColor to HSV
    r, g, b = init_color.R / 255.0, init_color.G / 255.0, init_color.B / 255.0
    h, s, v = colorsys.rgb_to_hsv(r, g, b)
    
    colors_list = []
    # First color is initColor
    colors_list.append(init_color)
    
    if num_colors > 1:
        # Calculate evenly spaced hues starting with the complement
        hue_step = 1.0 / num_colors
        for i in range(1, num_colors):
            # Offset hue by complement (0.5) and distribute evenly
            new_hue = (h + 0.5 + i * hue_step) % 1.0
            r, g, b = colorsys.hsv_to_rgb(new_hue, s, v)
            color = Color.FromArgb(int(r * 255), int(g * 255), int(b * 255))
            colors_list.append(color)
    
    return colors_list

# Process the input DataTree
if tree is not None and isinstance(tree, DataTree[object]) and tree.BranchCount > 0:
    num_branches = tree.BranchCount
    
    # Copy the input tree to the output with type conversion
    for i in range(tree.BranchCount):
        path = tree.Paths[i]
        branch_data = tree.Branch(path)
        # Convert each item to Grasshopper-compatible format
        converted_data = [convert_to_gh_compatible(item) for item in branch_data]
        inputTree.AddRange(converted_data, path)
    
    # Generate colors based on selected mode
    branch_colors = []
    selected_mode = get_mode(mode)
    
    if selected_mode == "gradient" and initColor is not None and endColor is not None:
        start_color = initColor if isinstance(initColor, Color) else Color.Black
        end_color = endColor if isinstance(endColor, Color) else Color.White
        for i in range(num_branches):
            t = i / (num_branches - 1) if num_branches > 1 else 0
            color = interpolate_color(start_color, end_color, t)
            branch_colors.append(color)
        mode_message = "Mode: gradient"
    elif selected_mode == "complementary" and initColor is not None:
        branch_colors = get_distributed_colors(initColor, num_branches)
        mode_message = "Mode: complementary"
    else:  # Default to random mode
        used_colors = set()
        for _ in range(num_branches):
            color = random_color(used_colors, seed)
            branch_colors.append(color)
            used_colors.add(color)
        mode_message = "Mode: random color"
    
    # Populate the colors DataTree to mirror the input tree structure
    for i in range(num_branches):
        path = tree.Paths[i]
        branch_data = tree.Branch(path)
        # Duplicate the color for each item in the branch
        color = branch_colors[i]
        color_list = [color] * len(branch_data)  # Repeat the color for each item in the branch
        colors.AddRange(color_list, path)
    
    # Handle flattening based on the flatten input
    flatten_message = "output flattened" if flatten else "keep datatree"
    if flatten:
        # Flatten colors
        flat_colors = DataTree[object]()
        flat_colors.AddRange([color for branch in colors.Branches for color in branch], GH_Path(0))
        colors = flat_colors
        
        # Flatten inputTree
        flat_input = DataTree[object]()
        all_data = []
        for i in range(inputTree.BranchCount):
            branch_data = list(inputTree.Branch(inputTree.Paths[i]))
            all_data.extend(branch_data)
        flat_input.AddRange(all_data, GH_Path(0))
        inputTree = flat_input
    
    # Update message with mode and flatten info
    message = f"{mode_message}\n{flatten_message}\n{num_branches} colors for {num_branches} branches"

# Update component message
ghenv.Component.Message = message
# ---------- end branchcolorgen ----------
wallorient = WallOrientation(startPt=start, endPt=end_2)  # -> out, OrCode, OrAngle, vector_line; inputs startPt: list of Point3d, endPt: list of Point3d, northRotation: list of Double; disabled
# ---------- wallorient: Python ----------
import math
import Rhino.Geometry as rg

# Grasshopper component details
ghenv.Component.Name = "Wall Orientation"
ghenv.Component.NickName = "WallOrient"
ghenv.Component.Message = "Wall Orientation\nV1.0"

def calculate_normal_vector(start, end):
    if not start or not end:
        return None, None

    # Extract coordinates from Rhino Point3d
    start_coords = [float(start.X), float(start.Y)]
    end_coords = [float(end.X), float(end.Y)]

    # Calculate midpoint
    midpoint = rg.Point3d(
        (start_coords[0] + end_coords[0]) / 2,
        (start_coords[1] + end_coords[1]) / 2,
        0
    )

    dx = end_coords[0] - start_coords[0]
    dy = end_coords[1] - start_coords[1]

    # Handle zero-length line
    if dx == 0 and dy == 0:
        return None, None

    # Calculate normal vector
    normal_vector = [-dy, dx]
    length = math.sqrt(normal_vector[0]**2 + normal_vector[1]**2)
    normal_vector = [
        normal_vector[0] / length,
        normal_vector[1] / length
    ]

    return normal_vector, midpoint

def calculate_orientation(normal_vector, north_rotation=0):
    if not normal_vector:
        return None
    angle = math.atan2(normal_vector[0], normal_vector[1])
    angle_degrees = math.degrees(angle)

    # Apply north rotation
    adjusted_angle = (angle_degrees - north_rotation) % 360

    return adjusted_angle

def get_orientation_code(angle):
    if angle is None:
        return None
    boundaries = {
        'N': [(337.5, 360), (0, 22.5)],
        'NE': (22.5, 67.5),
        'E': (67.5, 112.5),
        'SE': (112.5, 157.5),
        'S': (157.5, 202.5),
        'SW': (202.5, 247.5),
        'W': (247.5, 292.5),
        'NW': (292.5, 337.5)
    }

    for direction, angle_range in boundaries.items():
        if direction == 'N':
            if any(min_angle <= angle < max_angle for min_angle, max_angle in angle_range):
                return direction
        else:
            if isinstance(angle_range, tuple) and angle_range[0] <= angle < angle_range[1]:
                return direction

    return None

# Ensure inputs are lists
startPt = [startPt] if not isinstance(startPt, list) else startPt
endPt = [endPt] if not isinstance(endPt, list) else endPt
northRotation = [northRotation] if northRotation and not isinstance(northRotation, list) else (northRotation or [0])

# Initialize outputs
n = []        # Normal vectors as 2D lists
OrAngle = []  # Orientation angles in degrees
OrCode = []   # Orientation codes (N, NE, E, etc.)
RH_NV = []    # Rhino Vector3d objects
MP = []       # Midpoints of wall segments
VEC_LINE = [] # Vector lines at wall midpoints

# Process each wall
for start, end in zip(startPt, endPt):
    # Calculate normal vector and midpoint
    normal_vector, midpoint = calculate_normal_vector(start, end)

    # Skip invalid results
    if not normal_vector or not midpoint:
        n.append(None)
        OrAngle.append(None)
        OrCode.append(None)
        RH_NV.append(None)
        MP.append(None)
        VEC_LINE.append(None)
        continue

    # Determine orientation angle
    orientation_angle = calculate_orientation(normal_vector, northRotation[0])

    # Get orientation code
    orientation_code = get_orientation_code(orientation_angle)

    # Create Rhino vector
    rhino_vector = rg.Vector3d(normal_vector[0], normal_vector[1], 0)

    # Debugging vector creation
    print(f"Normal Vector Array: {normal_vector}")
    print(f"Rhino Vector3d: {rhino_vector}")

    # Create vector line with hardcoded length of 2
    vec_endpoint = rg.Point3d(
        midpoint.X + normal_vector[0] * 2,  # Length of vector is hardcoded as 2
        midpoint.Y + normal_vector[1] * 2,
        0
    )
    vector_line = rg.LineCurve(midpoint, vec_endpoint)

    # Append results
    n.append(normal_vector)
    OrAngle.append(orientation_angle)
    OrCode.append(orientation_code)
    RH_NV.append(rhino_vector)
    MP.append(midpoint)
    VEC_LINE.append(vector_line)

# Debug Outputs
print(f"Midpoints: {MP}")
print(f"Rhino Vectors: {RH_NV}")
print(f"Vector Lines: {VEC_LINE}")

# Grasshopper Outputs
n = n          # Normal vectors as 2D lists
OrAngle = OrAngle  # Orientation angles in degrees
OrCode = OrCode    # Orientation codes (N, NE, E, etc.)
RH_NV = RH_NV      # Rhino Vector3d objects
MP = MP            # Midpoints of wall segments
VEC_LINE = VEC_LINE  # Vector lines at wall midpoints
# ---------- end wallorient ----------
branchsel = TreeBranchSelector(input_tree=entwine_2, path_index=number_slider_3)  # -> out, selected_branch, other_branches, total_branches; inputs input_tree: tree, path_index: Int32; disabled
# ---------- branchsel: Python ----------
"""Inputs:
    input_tree: Tree structure to select from
    path_index_: Integer for branch selection"""

from Grasshopper import DataTree
from Grasshopper.Kernel.Data import GH_Path

# Initialize outputs
selected_branch = []
other_branches = DataTree[object]()  # Changed to DataTree to preserve branch structure
total_branches = 0

# Input validation
if input_tree is None:
    message = "Error: Input tree is required"
    print(message)
else:
    try:
        # Get all paths from the tree
        paths = input_tree.Paths
        total_branches = len(paths)
        
        if total_branches == 0:
            message = "Input tree is empty"
            print(message)
        else:
            # Convert path_index_ to int and handle bounds
            index = int(path_index_) % total_branches
            
            # Get the path at the specified index
            selected_path = paths[index]
            
            # Get branch data at the selected path
            selected_branch = list(input_tree.Branch(selected_path))
            
            # Get all other branches, preserving their structure
            for i, path in enumerate(paths):
                if i != index:
                    branch_data = list(input_tree.Branch(path))
                    other_branches.AddRange(branch_data, path)  # Add each branch with its original path
            
            message = (f"Selected branch {index} of {total_branches} (Path: {selected_path})\n"
                      f"Selected branch: {len(selected_branch)} items\n"
                      f"Other branches: {sum(1 for _ in other_branches.Paths)} branches with {sum(len(other_branches.Branch(p)) for p in other_branches.Paths)} items")
            print(message)
                
    except Exception as e:
        message = f"Error: {str(e)}"
        print(message)

# Update component properties
ghenv.Component.Name = "Tree Branch Selector"
ghenv.Component.NickName = 'BranchSel'
ghenv.Component.Message = message
# ---------- end branchsel ----------
parallel_list_filter = ParallelListFilter(NumList=pdecon_2.ZComponent, secList=brep_7, sValues=panel_10, sMode=querymode)  # -> out, filteredNum, filteredSec, filterPattern; inputs NumList: list of Double, secList: list, sValues: list of Double, sMode: String; disabled
# ---------- parallel_list_filter: Python ----------
import Grasshopper as gh
from Grasshopper import DataTree
from Grasshopper.Kernel.Data import GH_Path
import System
import Rhino.Geometry as rg  # Import for geometry handling

# Set component UI
ghenv.Component.Name = "Parallel List Filter"
ghenv.Component.Nickname = "PLFilter"

def filter_lists(NumList, secondary_list, search_values, filter_mode):
    # Ensure search_values is a list
    if not isinstance(search_values, list):
        search_values = [search_values] if search_values is not None else []
    
    # Initialize output
    filteredNum = DataTree[object]()  # Use DataTree to preserve all data types
    filteredSec = DataTree[object]()   # Use DataTree to preserve all data types
    pattern = []
    message = "Waiting for all inputs to be provided."
    
    if NumList is not None and secondary_list is not None and filter_mode:
        # Check if lists have matching lengths
        if len(NumList) != len(secondary_list):
            message = f"Error: Lists must have equal length.\nNumList: {len(NumList)}, secList: {len(secondary_list)}"
            return filteredNum, filteredSec, pattern, message
        
        pattern = [False] * len(NumList)  # Initialize pattern with False
        
        # Convert search_values to a set for faster lookup
        search_set = set(search_values)
        
        # Process based on filter mode
        if filter_mode in ["equals", "notFound", "greater", "smaller", "range", "closest"]:
            path = GH_Path(0)  # Single branch for non-group modes
            for i, (num_val, sec_val) in enumerate(zip(NumList, secondary_list)):
                # Try to handle numeric or comparable values, fall back to index-based filtering for geometry
                try:
                    if filter_mode == "equals" and num_val in search_set:
                        filteredNum.Add(num_val, path)
                        filteredSec.Add(sec_val, path)
                        pattern[i] = True
                    elif filter_mode == "notFound" and num_val not in search_set:
                        filteredNum.Add(num_val, path)
                        filteredSec.Add(sec_val, path)
                        pattern[i] = True
                    elif filter_mode == "greater" and isinstance(num_val, (int, float)) and num_val > max(search_set):
                        filteredNum.Add(num_val, path)
                        filteredSec.Add(sec_val, path)
                        pattern[i] = True
                    elif filter_mode == "smaller" and isinstance(num_val, (int, float)) and num_val < min(search_set):
                        filteredNum.Add(num_val, path)
                        filteredSec.Add(sec_val, path)
                        pattern[i] = True
                    elif filter_mode == "range" and len(search_set) >= 2:
                        min_val, max_val = min(search_set), max(search_set)
                        if isinstance(num_val, (int, float)) and min_val <= num_val <= max_val:
                            filteredNum.Add(num_val, path)
                            filteredSec.Add(sec_val, path)
                            pattern[i] = True
                    elif filter_mode == "closest" and isinstance(num_val, (int, float)):
                        closest_val = min(search_set, key=lambda x: abs(x - num_val))
                        filteredNum.Add(closest_val, path)
                        filteredSec.Add(sec_val, path)
                        pattern[i] = True
                except (TypeError, ValueError):
                    # If comparison fails (e.g., geometry), skip or use index-based filtering
                    pass
            
            count = filteredNum.BranchCount if filteredNum.BranchCount > 0 else 0
            if filter_mode == "equals":
                message = f"Equals {search_values}\nFound {count}/{len(NumList)}"
            elif filter_mode == "notFound":
                message = f"Not Found in 'sValues'\nNot found {count}/{len(NumList)}"
            elif filter_mode == "greater":
                message = f"Greater than {max(search_set)}\nFound {count}/{len(NumList)}"
            elif filter_mode == "smaller":
                message = f"Smaller than {min(search_set)}\nFound {count}/{len(NumList)}"
            elif filter_mode == "range":
                message = f"Range {min(search_set)} to {max(search_set)}\nFound {count}/{len(NumList)}"
            elif filter_mode == "closest":
                message = f"Closest to {search_values}\nFound {count}/{len(NumList)}"
        
        elif filter_mode == "group_equals":
            groups = {val: [] for val in search_set}
            for i, num_val in enumerate(NumList):
                if num_val in search_set:
                    groups[num_val].append(i)
                    pattern[i] = True
            
            total_matches = 0
            for idx, search_val in enumerate(search_set):
                path = GH_Path(idx)
                indices = groups.get(search_val, [])
                num_values = [NumList[i] for i in indices]
                sec_values = [secondary_list[i] for i in indices]
                if num_values:
                    filteredNum.AddRange(num_values, path)
                    filteredSec.AddRange(sec_values, path)
                total_matches += len(num_values)
            
            message = f"Group Equals {search_values}\nFound {total_matches} in {len(search_set)} branches"
        
        elif filter_mode == "group_unique":
            unique_values = list(set(secondary_list))  # Get unique values from secList
            groups = {val: [] for val in unique_values}
            
            for i, sec_val in enumerate(secondary_list):
                groups[sec_val].append(i)
                pattern[i] = True  # All items are grouped, so mark as True
            
            total_matches = 0
            for idx, unique_val in enumerate(unique_values):
                path = GH_Path(idx)
                indices = groups.get(unique_val, [])
                num_values = [NumList[i] for i in indices]
                sec_values = [secondary_list[i] for i in indices]
                if num_values:
                    filteredNum.AddRange(num_values, path)
                    filteredSec.AddRange(sec_values, path)
                total_matches += len(num_values)
            
            message = f"Group Unique from secList\nFound {total_matches} in {len(unique_values)} branches"
        
        else:
            message = f"Invalid filter mode. Use 'equals', 'notFound', 'greater', 'smaller', 'range', 'closest', 'group_equals', or 'group_unique'."
    
    return filteredNum, filteredSec, pattern, message

# Process the filtering
filteredNum, filteredSec, filterPattern, msg = filter_lists(NumList, secList, sValues, sMode)
ghenv.Component.Message = msg
# ---------- end parallel_list_filter ----------
prop_db = OpenWebsiteButton(Run=button)  # -> out; inputs Run: Boolean; disabled
# ---------- prop_db: Python ----------
import System
from System.Diagnostics import ProcessStartInfo, Process

def open_website(url):
    """Opens the specified URL in the default browser."""
    start_info = ProcessStartInfo()
    start_info.FileName = url
    start_info.UseShellExecute = True
    Process.Start(start_info)

# Set the component's name, nickname, and message
ghenv.Component.Name = "Open Website Button"
ghenv.Component.NickName = "Prop_DB"
ghenv.Component.Message = "Properties GUID\nV1.0"  # Add a second line with "\n"

# Inputs
if Run:  # 'Run' is a Boolean input
    open_website("https://app.teable.io/share/shr9bgmnGnhrkkFXh13/view")  # Replace with your URL
# ---------- end prop_db ----------
panel_11 = Panel(mlfilter.out1)  # disabled
panel_12 = Panel(mlfilter.out2)  # disabled
panel_13 = Panel(mlfilter.out3)  # disabled
panel_14 = Panel(mlfilter.out4)  # disabled
geo = Geometry(parallel_list_filter.filteredSec)  # disabled
panel_15 = Panel(grouptree.output_tree)  # disabled
panel_16 = Panel(grouptree.unique_values)  # disabled
panel_17 = Panel(wallorient.OrCode)  # disabled
panel_18 = Panel(wallorient.OrAngle)  # disabled
geo_2 = Geometry(wallorient.vector_line)  # disabled
preview = CustomPreview(Geometry=branchcolorgen.inputTree, Material=branchcolorgen.colors)  # disabled
geo_3 = Geometry(branchsel.selected_branch)  # disabled
geo_4 = Geometry(branchsel.other_branches)  # disabled
panel_19 = Panel(filter_contains.filtered_list)  # disabled
panel_20 = Panel(filter_contains.filtered_indices)  # disabled
panel_21 = Panel(filter_contains.count)  # disabled
panel_22 = Panel(filter_contains.pattern)  # disabled
geo_5 = Geometry(grouptree.output_tree)  # disabled
panel_23 = Panel(parallel_list_filter.filteredNum)  # disabled
panel_24 = Panel(geo)  # disabled
panel_25 = Panel(parallel_list_filter.filterPattern)  # disabled
panel_26 = Panel(geo_4)  # disabled
panel_27 = Panel(geo_3)  # disabled

swatch_3 = ColourSwatch(SwatchColor=RGB(8, 0, 255))  # disabled
end_3 = EndPoints(Curve=geo_2)  # -> Start, End; disabled
tag = TextTag(Location=end_3.End, Text=panel_17, Colour=swatch_3)  # disabled

panel_28 = Panel(branchsel.total_branches)  # disabled
brep_13 = Brep([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])
panel_29 = Panel("""a word
this is a sentence
this is a key to search
This is a fourth line
another line with
keynote""")
brep_14 = Brep([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])
brep_15 = Brep([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])
brep_16 = Brep([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])
brep_17 = Brep([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])
volume_4 = Volume(Geometry=brep_13)  # -> Volume, Centroid
brep_18 = Brep([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])
brep_19 = Brep([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])
# C# NODES
entwine_3 = Entwine(Branch00=brep_17, Branch01=brep_15, Branch02=brep_14, Branch03=brep_16, FlattenInputs=True)
series_3 = Series(Start=0, Step=1, Count=Slider(5, range=0..10))
pt_2 = Point(volume_4.Centroid)
querymode_2 = QueryMode({"greater", "smaller", "equals", "closest", "group_equals", "group_unique"}, selected="smaller")
series_4 = Series(Start="3", Step="3", Count=Slider(5, range=0..10))
volume_5 = Volume(Geometry=brep_18)  # -> Volume, Centroid
crv_2 = Curve(graft([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]))
brep_20 = Brep([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])
volume_6 = Volume(Geometry=brep_19)  # -> Volume, Centroid
brep_21 = Brep([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])
pdecon_3 = Deconstruct(Point=pt_2)  # -> XComponent, YComponent, ZComponent
brep_22 = Brep([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])
brep_23 = Brep([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])
brep_24 = Brep([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])
panel_30 = Panel(series_3)
panel_31 = Panel(series_4)
colormode_2 = ColorModeValList({"gradient", "random", "complementary"}, selected="complementary")
pdecon_4 = Deconstruct(Point=volume_5.Centroid)  # -> XComponent, YComponent, ZComponent
end_4 = EndPoints(Curve=crv_2)  # -> Start, End
addition_2 = Addition(A=pdecon_3.XComponent, B=pdecon_3.YComponent)
entwine_4 = Entwine(Branch00=brep_24, Branch01=brep_22, Branch02=brep_21, Branch03=brep_23, FlattenInputs=True)
parallel_list_filter_2 = ParallelListFilter(PrimaryList=pdecon_4.ZComponent, SecondaryList=brep_18, SearchValues="41.5", FilterMode=querymode_2)  # -> FilteredPrimary, FilteredSecondary, FilterPattern
start_2 = EleFrontDataDescription(end_4.Start, ShiftDepth=0, isNameSet=False)
end_5 = EleFrontDataDescription(end_4.End, ShiftDepth=0, isNameSet=False)
multi_list_filter = MultiListFilter(List1=volume_6.Centroid, List2=brep_20, List3=panel_30, List4=panel_31, Index=Slider(3, range=0..10))  # -> Out1, Out2, Out3, Out4
group_to_tree = GroupToTree(DataList=brep_13, ValuesList=addition_2)  # -> OutputTree, UniqueValues, BranchCounts
filter_contains_string = FilterContainsString(StringsList=panel_29, SearchString="Key", CaseSensitive=Toggle(False), WholeWords=Toggle(False))  # -> FilteredList, FilteredIndices, Count, Pattern
wall_orientation = WallOrientation(StartPoints=start_2, EndPoints=end_5, NorthRotation=0)  # -> NormalVectors, OrientationAngles, OrientationCodes, RhinoVectors, Midpoints, VectorLines
branch_color_generator = BranchColorGenerator(
    Tree=entwine_3,
    StartingColor=ColourSwatch(SwatchColor=RGB(204, 255, 94)),
    EndColor=ColourSwatch(SwatchColor=RGB(255, 0, 255)),
    Seed=Slider(234, range=0..1000),
    Flatten=Toggle(True),
    Mode=colormode_2)  # -> GeneratedColors, InputTree
tree_branch_selector = TreeBranchSelector(InputTree=entwine_4, PathIndex=Slider(2, range=0..10))  # -> SelectedBranch, OtherBranches, TotalBranches
open_website_button = OpenWebsiteButton()
geo_6 = Geometry(parallel_list_filter_2.FilteredSecondary)
panel_32 = Panel(multi_list_filter.Out1)
panel_33 = Panel(multi_list_filter.Out2)
panel_34 = Panel(multi_list_filter.Out3)
panel_35 = Panel(multi_list_filter.Out4)
panel_36 = Panel(parallel_list_filter_2.FilteredPrimary)
panel_37 = Panel(geo_6)
panel_38 = Panel(group_to_tree.UniqueValues)
panel_39 = Panel(group_to_tree.BranchCounts)
panel_40 = Panel(filter_contains_string.FilteredList)
panel_41 = Panel(wall_orientation.OrientationAngles)
panel_42 = Panel(wall_orientation.OrientationCodes)
panel_43 = Panel(branch_color_generator.GeneratedColors)
panel_44 = Panel(branch_color_generator.InputTree)
panel_45 = Panel(filter_contains_string.FilteredIndices)
geo_7 = Geometry(wall_orientation.VectorLines)
panel_46 = Panel(filter_contains_string.Count)
panel_47 = Panel(filter_contains_string.Pattern)
geo_8 = Geometry(group_to_tree.OutputTree)
geo_9 = Geometry(tree_branch_selector.SelectedBranch)
geo_10 = Geometry(tree_branch_selector.OtherBranches)
panel_48 = Panel(parallel_list_filter_2.FilterPattern)

end_6 = EndPoints(Curve=geo_7)  # -> Start, End
tag_2 = TextTag(Location=end_6.End, Text=panel_42, Colour=ColourSwatch(SwatchColor=RGB(8, 0, 255)))

panel_49 = Panel(geo_10)
panel_50 = Panel(geo_9)
panel_51 = Panel(tree_branch_selector.TotalBranches)
preview_2 = CustomPreview(Geometry=branch_color_generator.InputTree, Material=branch_color_generator.GeneratedColors)
