# Grasshopper definition ARCHICAD_API_TUTORIAL.gh (Grasshopper 1.0.7)
# plug-ins: Grasshopper-ARCHICAD Live Connection built for Rhinoceros 7

# ----
# 3.2  Collect Elements by Type
number_slider = Slider(0, range=0..17)
getelementsbytype = GetAllElementsByType(ElementType=number_slider, SerializeElements=Toggle(False))  # -> printToPanel, ElementsOfType; inputs ElementType: Int32, SerializeElements: Boolean
# ---------- getelementsbytype: Python ----------
ghenv.Component.Name = 'Get All elements by Type'
ghenv.Component.NickName = 'GetElementsByType'
ghenv.Component.Message = '0.1'
ghenv.Component.Category = 'ARCHICAD'
ghenv.Component.SubCategory = 'API3'
ghenv.Component.Description = '''
Collects GUIDS of all elements in a project by thier type
INPUT:
	ElementType  : int Choose type. Connect Number slider from 0 to 17
				
OUTPUT:
	printToPanel 	: string - Display list of all types. 
	ElementsOfType 	: dict - Elements packed to dictionary
'''

import api2 as p
reload(p)

ports = p.get_active_port()

el_types = p.getElementsTypes()

if ElementType is not None and isinstance(ElementType,int):
	wrapped_ElementType = p.get_wrapped_value(ElementType,el_types)

	printToPanel = p.show_menu('Element Types',el_types,wrapped_ElementType)

	choosen_type = el_types[wrapped_ElementType]


	_ElementsOfType=[]
	for port in ports:
		elem = p.getElementsByType(choosen_type,port)
		elem = p.unpack(elem)['elements']
		_ElementsOfType+=elem
	if SerializeElements:   
		ElementsOfType = p.packlist(_ElementsOfType)
	else:
		ElementsOfType = _ElementsOfType

	# ElementsOfType = p.pack('elements',_ElementsOfType)
else:
	printToPanel = 'CAUTION:\nConnect Number Slider to <ElementType> Input'
# ---------- end getelementsbytype ----------
panel = Panel(getelementsbytype.printToPanel)
panel_2 = Panel(getelementsbytype.ElementsOfType)
list_length = ListLength(List=getelementsbytype.ElementsOfType)
panel_3 = Panel(list_length)

# ----
# 2.Classification systems
# 2.1 Get Classification system
number_slider_2 = Slider(0, range=0..5)
getallclassificationsystems = GetAllClassificationSystems(PickSystem=number_slider_2)  # -> ClassificationSystems, Name, Source, Version, Date, Description, ClassSystemID
# ---------- getallclassificationsystems: Python ----------
ghenv.Component.Name = 'Get All Classification Systems'
ghenv.Component.NickName = 'GetAllClassificationSystems'
ghenv.Component.Message = '0.1'
ghenv.Component.Category = 'ARCHICAD'
ghenv.Component.SubCategory = 'API3'
ghenv.Component.Description = '''
Collects all classifications systems
INPUT:
	PickSystem    : int  		: Picks Property group
						  

OUTPUT:
	ClassificationSystems 	    : Message 	 
	Name 						: String
	Name 						: String
'''



import  api2 as api 


ports = api.get_active_port()

_systems=[]
if len(ports)>0 and PickSystem is not None :
	for port in ports:
		_systems += api.getAllClassificationSystems(port)

	_class_name=[]
	for s in _systems:
		_class_name.append(s['name'])

	PickSystem_wrapped = api.get_wrapped_value(PickSystem,_class_name)
	ClassificationSystems = api.show_menu('CLASSIFICATION SYSTEMS',_class_name,PickSystem_wrapped)
	Name = _systems[PickSystem_wrapped]['name']
	Source = _systems[PickSystem_wrapped]['source']
	Version = _systems[PickSystem_wrapped]['version']
	Date = _systems[PickSystem_wrapped]['date']
	Description = _systems[PickSystem_wrapped]['description']
	ClassSystemID = _systems[PickSystem_wrapped]['guid']
# ---------- end getallclassificationsystems ----------
panel_4 = Panel(getallclassificationsystems.ClassificationSystems)
panel_5 = Panel(getallclassificationsystems.Name)
panel_6 = Panel(getallclassificationsystems.Date)
panel_7 = Panel(getallclassificationsystems.Source)
panel_8 = Panel(getallclassificationsystems.Version)
panel_9 = Panel(getallclassificationsystems.Description)
panel_10 = Panel(getallclassificationsystems.ClassSystemID)

# ----
# 3. Collect elements
# 3.1  Collect All Elements
boolean_toggle = BooleanToggle(True)
getallelements = GetAllElements(SerializeElements=boolean_toggle)  # -> ElementsID; inputs SerializeElements: Boolean
# ---------- getallelements: Python ----------
ghenv.Component.Name = 'Get All Elements'
ghenv.Component.NickName = 'GetAllElements'
ghenv.Component.Message = '0.1'
ghenv.Component.Category = 'ARCHICAD'
ghenv.Component.SubCategory = 'API3'
ghenv.Component.Description = '''
Collects GUIDS of all elements in a project 
				
OUTPUT:
	ElementsID 	: dict - Elements packed to dictionary
'''

import api2 as p


ports = p.get_active_port()

_ElementsID=[]
if len(ports)>0:
	# port = ports[0]
	for port in ports:
		el = p.getAllElements(port)
		el = p.unpack(el)
		_ElementsID+=el['elements']
	print type(_ElementsID),len(_ElementsID)
	
	if SerializeElements:
		ElementsID = p.packlist(_ElementsID) 
	else:
		ElementsID = _ElementsID 
	# ElementsID = p.pack('elements',_ElementsID)
# ---------- end getallelements ----------
panel_11 = Panel(getallelements)
list_length_2 = ListLength(List=getallelements)
panel_12 = Panel(list_length_2)

# ----
# 3.4  Collect Elements from Archicad’s schedule
number_slider_3 = Slider(1, range=0..10)
file_path = FilePath("/Users/GrzegorzWilk/Documents/00-KLIENCI/ENZYME/01_API/GH_nodes/API_3/api3_databases/Walls_group_1.txt")
archicadschedule = ARCHICADSchedule(csvFile=file_path, IdFields=number_slider_3, ValuesFields=Slider(2, range=0..10))  # -> printHeaders, ElementsID, Values; inputs IdFields: Int32
# ---------- archicadschedule: Python ----------
ghenv.Component.Name = 'ARCHICAD Schedule'
ghenv.Component.NickName = 'ARCHICADSchedule'
ghenv.Component.Message = '0.1'
ghenv.Component.Category = 'ARCHICAD'
ghenv.Component.SubCategory = 'API3'
ghenv.Component.Description = '''Reads archicad's schedule saved 
as tabbed txt  file

'''
import api2 as api
import csv
import json
# print(csvFile)
if Delimiter is None:
    Delimiter = '\t'
data = []
ids = []
headers = []
_headers = []
if IdFields is not None and ValuesFields is not None and csvFile is not None:
	with open(csvFile, 'r') as f:
		reader = csv.reader(f,delimiter=Delimiter)
		for row in reader:
			_headers.append(row)
		headers = _headers[0]

	wrapped_IdFields = api.get_wrapped_value(IdFields,headers)
	wrapped_valuesFields = api.get_wrapped_value(ValuesFields,headers)
	printHeaders = api.show_menu_two_inputs('DATA HEADERS',headers,wrapped_IdFields,wrapped_valuesFields)
	# printHeaders = api.show_menu('DATA HEADERS',headers,wrapped_IdFields)





	with open(csvFile, 'r') as f:
		csvData = csv.reader(f,delimiter=Delimiter)
		
		for row in csvData:
			data.append(row[wrapped_IdFields])
			ids.append(row[wrapped_valuesFields])
		data.pop(0)
		ids.pop(0)



	# pack = json.dumps({'elements':data},)
	ElementsID = api.packlist(data)
	Values = api.packlist(ids)

	# Values = ids
else:
	printHeaders = 'Connect number sliders to IdFields and valuesFields Inputs\nConnect FilePath node to csvFile Input'
# ---------- end archicadschedule ----------
panel_13 = Panel(archicadschedule.printHeaders)
panel_14 = Panel(archicadschedule.ElementsID)
panel_15 = Panel(archicadschedule.Values)

# ----
# 2.2 Get Classification
number_slider_4 = Slider(0, range=0..30)
getclassificationsinsystem = GetClassificationsInSystem(PickClass=number_slider_4, ClassSystemID=panel_10)  # -> printToPanel, ClassID, ClassName, ClassDescription, ClassGUID; inputs PickClass: Int32
# ---------- getclassificationsinsystem: Python ----------
ghenv.Component.Name = 'Get Classifications In System'
ghenv.Component.NickName = 'GetClassificationsInSystem'
ghenv.Component.Message = '0.1'
ghenv.Component.Category = 'ARCHICAD_API'
ghenv.Component.SubCategory = 'Classification'
ghenv.Component.Description = '''
Collects all classifications systems
INPUT:
	PickSystem    : int  		: Picks Property group
						  

OUTPUT:
	ClassificationSystems 	    : Message 	 
	Name 						: String
	Name 						: String
'''

#https://archicadapi.graphisoft.com/JSONInterfaceDocumentation/#GetAllClassificationsInSystem

import  api2 as api 
ports = api.get_active_port()
port = ports[0]
classifications_menu=[]
className 	= []
classId 	= []
classDesc 	= []
classGUID 	= []
if len(ports)>0 and PickClass is not None:
	# for port in ports:
	classes = api.GetAllClassificationsInSystem(port,ClassSystemID)
	for c in classes:
		classifications_menu.append(c['classificationItem']['id'])
		classId.append(c['classificationItem']['id'])
		className.append(c['classificationItem']['name'])
		classDesc.append(c['classificationItem']['description'])
		classGUID.append(c['classificationItem']['classificationItemId']['guid'])
		try:
			for child in c['classificationItem']['children']:
				classifications_menu.append('\t\t|__\t'+child['classificationItem']['id'])
				classId.append(child['classificationItem']['id'])
				classGUID.append(child['classificationItem']['classificationItemId']['guid'])
				className.append(child['classificationItem']['name'])
				classDesc.append(child['classificationItem']['description'])

		except:
			pass
	PickClass_wrapped = api.get_wrapped_value(PickClass,classifications_menu)
	printToPanel = api.show_menu('CLASSIFICATIONS IN {}'.format('system'),classifications_menu,PickClass_wrapped)
	
	ClassID = classId[PickClass_wrapped]
	ClassGUID = classGUID[PickClass_wrapped]
	ClassName = className[PickClass_wrapped]
	ClassDescription = classDesc[PickClass_wrapped]
	# for c  in classifications:

	# 	print c
else:	
	print 'Connect INPUT'
# ---------- end getclassificationsinsystem ----------
panel_16 = Panel(getclassificationsinsystem.ClassID)
panel_17 = Panel(getclassificationsinsystem.ClassName)
panel_18 = Panel(getclassificationsinsystem.ClassDescription)
panel_19 = Panel(getclassificationsinsystem.ClassGUID)
panel_20 = Panel(getclassificationsinsystem.printToPanel)

# ----
# 3.3 Get Elements by classification
panel_21 = Panel(panel_19)
getelementsbyclassification = GetElementsByClassification(ClassGUID=panel_21, SerializeElements=Toggle(False))  # -> ElementsID; inputs SerializeElements: Boolean
# ---------- getelementsbyclassification: Python ----------
ghenv.Component.Name = 'Get Elements by Classification'
ghenv.Component.NickName = 'GetElementsByClassification'
ghenv.Component.Message = '0.1'
ghenv.Component.Category = 'ARCHICAD_API'
ghenv.Component.SubCategory = 'Classification'
ghenv.Component.Description = '''
Collects all classifications systems
INPUT:
	PickSystem    : int  		: Picks Property group
						  

OUTPUT:
	ClassificationSystems 	    : Message 	 
	Name 						: String
	Name 						: String
'''

# https://archicadapi.graphisoft.com/JSONInterfaceDocumentation/#GetElementsByClassification

import  api2 as api 
ports = api.get_active_port()
port = ports[0]
run = api.get_global_toggle()


if len(ports)>0 and ClassGUID is not None:
    
	_elementsID = api.GetElementsByClassification(port,ClassGUID)

	if SerializeElements:   
		ElementsID = _elementsID
	else:
		ElementsID = api.unpack(_elementsID)
		
else:
	printToPanel = 'Connect all inputs'
# ---------- end getelementsbyclassification ----------
list_length_3 = ListLength(List=getelementsbyclassification)
panel_22 = Panel(getelementsbyclassification)
panel_23 = Panel(list_length_3)

# ----
# Classification ID
panel_24 = Panel(panel_19)

# ----
# Classification System ID
panel_25 = Panel()

# ----
# 3.4 Set Elements Classification
setclassificationofelements = SetClassificationOfElements(ClassGUID=panel_24, ClassSystemID=panel_25)  # -> printToPanel
# ---------- setclassificationofelements: Python ----------
ghenv.Component.Name = 'Set Classification Of Elements'
ghenv.Component.NickName = 'SetClassificationOfElements'
ghenv.Component.Message = '0.1'
ghenv.Component.Category = 'ARCHICAD_API'
ghenv.Component.SubCategory = 'Classification'
ghenv.Component.Description = '''
Collects all classifications systems
INPUT:
	PickSystem    : int  		: Picks Property group
						  

OUTPUT:
	ClassificationSystems 	    : Message 	 
	Name 						: String
	Name 						: String
'''

#https://archicadapi.graphisoft.com/JSONInterfaceDocumentation/#SetClassificationsOfElements

import  api2 as api 
ports = api.get_active_port()
port = ports[0]
run = api.get_global_toggle()

if len(ports)>0 and ElementsID is not None and ClassSystemID is not None and ClassGUID is not None:
	_elementsID = api.unpack(ElementsID)

	json_def = api.SetClassificationsOfElements(port,_elementsID,ClassSystemID,ClassGUID)

	result = api.connect(json_def,port)
	printToPanel = result['succeeded']
else: 
	printToPanel = 'Connect all INPUT wires'
# ---------- end setclassificationofelements ----------
panel_26 = Panel(setclassificationofelements)

# ----
# 1. Connect to open port
number_slider_5 = Slider(0, range=0..1)

pickport = PickConnectionPort(Synchronise=Toggle(True), pickPort=number_slider_5, RunGlobally=Toggle(False))  # -> printToPanel; inputs Synchronise: Boolean, pickPort: Int32, RunGlobally: Boolean
# ---------- pickport: Python ----------
ghenv.Component.Name = 'Pick connection port'
ghenv.Component.NickName = 'PickPort'
ghenv.Component.Message = '0.1'
ghenv.Component.Category = 'ARCHICAD'
ghenv.Component.SubCategory = 'API3'
ghenv.Component.Description = '''
Checks avaliable connection ports and dallows to pick one or all
INPUT:
	Synchronise  : bool Checks avaliable ports. 
						For performance reason should be set to false after first run
	pickPort     : int  Connect Integer type <Number Node> 
	RunGlobally  : bool Turns on/off global variable on which depends  other nodes performance.   
OUTPUT:
	printToPanel : string Message
'''
# ghenv.Component.AdditionalHelpFromDocStrings = '1'



import api2 as api
reload(api)
printToPanel = Synchronise
api.set_global_toggle(RunGlobally)
p=None
ports = []

if Synchronise == True:

    ports = api.open_ports()
    
    p = api.get_port()

    if len(p)>1:
        p =  p + [p]

if p and pickPort is not None:
    wrapped_pickPort = api.get_wrapped_value(pickPort,p)
    printToPanel = api.show_menu('Avaliable ports',p,wrapped_pickPort)
    api.set_active_port(p[wrapped_pickPort])
else:
    printToPanel = 'Plug Boolean Toggle node to Synchronise Input\nand Number Slider to pickPort Input'
# ---------- end pickport ----------

# ----
# PICK CONNECTION - each copy of archicad
# has it’s own port number.
# This node must be run as a first to check open ports and write them to gh global variable
# (via sticky) to be used by other
# nodes that comunicate with ARCHICAD.
# After selecting a port, Synchronise Input shpuld be
# set to False to not search for ports with every scheme run.
# Run Globally is another global variable  currently
# used only by “Set property value node”.
#  It prevents nodes from performing thier actions
# like setting values to Properties.
panel_27 = Panel(pickport)

# ----
# 3.3  Collect Elements with Live Connection
wall = Wall([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])
column = Column([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])
morph = Morph([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])
merge = Merge(Data1=wall, Data2=column, Data3=morph)
getelementsid = GetElementsID(Elements=merge)  # -> ElementsID
# ---------- getelementsid: Python ----------
ghenv.Component.Name = 'Get Elements ID'
ghenv.Component.NickName = 'GetElementsID'
ghenv.Component.Message = '0.1'
ghenv.Component.Category = 'ARCHICAD'
ghenv.Component.SubCategory = 'API3'
ghenv.Component.Description = '''
Output elements guids from Archicad element containers                
INPUT:
    Elements from Archicad container. All types allowed
OUTPUT:
    ElementsID  : Json object consist of collected guids
'''

import api2 
reload(api2)

if Elements is not None:
    ElementsID = str(Elements.Guid)
# ---------- end getelementsid ----------
panel_28 = Panel(getelementsid)

serialize_list = SerializeList(list=getelementsid)

panel_29 = Panel(serialize_list)

# ----
# 7. Set property Value
# 7.1. Get “Element ID” Property
# 7.2. Get elements
# (Live Connection Container)
number_slider_6 = Slider(15, range=0..30)
wall_2 = Wall([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])
getelementsid_2 = GetElementsID(Elements=wall_2)  # -> ElementsID; same code as getelementsid
panel_30 = Panel(getelementsid_2)
serialize_list_2 = SerializeList(list=panel_30)
list_length_4 = ListLength(List=panel_30)
series = Series(Start=Slider(3, range=0..10), Step=1, Count=list_length_4)
concatenate = Concatenate(FragmentA="new_value_", FragmentB=series)
panel_31 = Panel(concatenate)
serialize_list_3 = SerializeList(list=panel_31)
panel_32 = Panel(serialize_list_2)
panel_33 = Panel(serialize_list_3)
button = Button()

getbuiltinpropertyid = GetBuiltInPropertyID(PropertyType=number_slider_6, Property=Slider(1, range=0..30))  # -> PropertyGroups, PropertiesOfType, PropertyID; inputs PropertyType: Int32
# ---------- getbuiltinpropertyid: Python ----------
ghenv.Component.Name = 'Get BuiltIn Property ID'
ghenv.Component.NickName = 'GetBuiltInPropertyID'
ghenv.Component.Message = '0.1'
ghenv.Component.Category = 'ARCHICAD'
ghenv.Component.SubCategory = 'API3'
ghenv.Component.Description = '''
Checks avaliable connection ports and dallows to pick one or all
INPUT:
	PropertyType    : int  		: Picks Property group
	Property        : int  		: Picks properties in group
						  

OUTPUT:
	PropertyGroups 	: Message 	:Property groups based on name prefix 
	PropertiesOfType 	: Message 	:properties in group

	PropertyID 			: string 	: GUID of property
'''


import api2 as api 

#read avaliable ports from GH global (sticky)
ports = api.get_port()
if ports == False:
    port = 0
else:
    port = ports[0]


if ports != False and len(ports)>0 and (PropertyType is not None and Property is not None):

	property_names = api.getBuiltInPropertyNames(port) # get names of builtIn properties
	property_types = api.getBuiltInPropertyTypes(port) # get types from names (first word before underscore)

	PropertyType_wrapped = api.get_wrapped_value(PropertyType,property_types) # wrapup input number slide node to fit list lenngth
	PropertyGroups  = api.show_menu('PROPERTY TYPES',property_types,PropertyType_wrapped)

	_properties_of_type = api.getBuiltInPropertiesOfType(property_names,port,property_types[PropertyType_wrapped]) 

	Property_wrapped = api.get_wrapped_value(Property,_properties_of_type)
	PropertiesOfType = api.show_menu('{} PROPERTIES'.format(property_types[PropertyType_wrapped]), _properties_of_type,Property_wrapped)

	property_name = _properties_of_type[Property_wrapped]

	# PropertyID = property_name
	PropertyID = api.getBuiltInPropertyId(property_name,port)

else:
	PropertyGroups = 'Plug INPUTS'
# ---------- end getbuiltinpropertyid ----------

# ----
# 8. Filter Elements
getbuiltinpropertyid_2 = GetBuiltInPropertyID(PropertyType=15, Property=1)  # -> PropertyGroups, PropertiesOfType, PropertyID; inputs PropertyType: Int32; same code as getbuiltinpropertyid
getallelements_2 = GetAllElements(SerializeElements=True)  # -> ElementsID; inputs SerializeElements: Boolean; same code as getallelements
panel_34 = Panel(getallelements_2)
getpropertyvalue = GetPropertyValue(PropertyID=getbuiltinpropertyid_2.PropertyID, ElementsID=getallelements_2, SerializeList=1)  # -> PropertyValue; inputs SerializeList: Boolean
# ---------- getpropertyvalue: Python ----------
ghenv.Component.Name = 'Get Property Value'
ghenv.Component.NickName = 'GetPropertyValue'
ghenv.Component.Message = '0.1'
ghenv.Component.Category = 'ARCHICAD'
ghenv.Component.SubCategory = 'API3'
ghenv.Component.Description = '''
Gets value of given property GUID
INPUT:
	PropertyID         : string  : GUID of Property
	ElementsID         : dict    : dictionary of elements GUID
	UnpackValue        : dict    : dictionary of elements GUID
						  

OUTPUT:
	PropertyValue 	    : dict 	 : Dicionary with 3 keys: value,type and status
	
'''


import api2 as api 

ports = api.get_port()
port = ports[0]


if len(ports)>0 and (PropertyID is not None and ElementsID is not None):
	# if isinstance(ElementsID,str):
	if len(ElementsID)!=36:
		ElementsID = api.unpack(ElementsID)
	else:
		ElementsID = [ElementsID]


	property_value = api.getPropertyValue(ElementsID,[PropertyID],port)
	# print property_value



# ports = api.get_port()
# port = ports[0]

values=[]
if len(ports)>0 and (PropertyID is not None and ElementsID is not None):
	el = ElementsID
	# el = api.unpack(ElementsID)
	# el = api.unpack(ElementsID)['elements']
	property_value = api.getPropertyValue(el,[PropertyID],port)
	for i in property_value:
		values.append(i)
		# values.append(i['value'])

	if SerializeList:
		PropertyValue = api.packlist(property_value)	
	else:
		__val=[]
		for i in values:
			__val.append(i['value'])
			PropertyValue = __val
		# PropertyValue = values
# ---------- end getpropertyvalue ----------
deserializeproperty = DeserializeProperty(SerializedProperty=getpropertyvalue)  # -> PropertyValue, PropertyType, PropertyStatus
# ---------- deserializeproperty: Python ----------
ghenv.Component.Name = 'Deserialize Property'
ghenv.Component.NickName = 'DeserializeProperty'
ghenv.Component.Message = '0.1'
ghenv.Component.Category = 'ARCHICAD'
ghenv.Component.SubCategory = 'API3'
ghenv.Component.Description = '''
Deserialize json object that represents property dictionary
				
OUTPUT:
	
'''

import api2 as api

if SerializedProperty is not None:
	lista=[]
	lista = api.unpack(SerializedProperty)
	print lista
	# key_value = lista.items()
	# key = key_value[0][0]
	# _Values = lista[key]


	_ParameterValue=[]
	_ParameterType=[]
	_ParameterStatus=[]

	for v in lista:
		_ParameterValue.append(v['value'])
		_ParameterType.append(v['type'])
		_ParameterStatus.append(v['status'])

	PropertyValue= _ParameterValue
	PropertyType= _ParameterType
	PropertyStatus= _ParameterStatus
# ---------- end deserializeproperty ----------
deserializelist = DeserializeList(SerializedList=panel_34)  # -> List
# ---------- deserializelist: Python ----------
ghenv.Component.Name = 'Deserialize List'
ghenv.Component.NickName = 'DeserializeList'
ghenv.Component.Message = '0.1'
ghenv.Component.Category = 'ARCHICAD'
ghenv.Component.SubCategory = 'API3'
ghenv.Component.Description = '''Deserialize json object in to list

'''

import api2

if SerializedList is not None and '[' in SerializedList :
    List = api2.unpack(SerializedList)
# ---------- end deserializelist ----------
panel_35 = Panel("Controller 01")
filter_elements = FilterElements(values=deserializeproperty.PropertyValue, elementid=deserializelist, criteria="SZ")

deserializelist_2 = DeserializeList(SerializedList=filter_elements)  # -> List; same code as deserializelist

panel_36 = Panel(deserializelist_2)

panel_37 = Panel(getbuiltinpropertyid.PropertyGroups)
panel_38 = Panel(getbuiltinpropertyid.PropertyID)
panel_39 = Panel(getbuiltinpropertyid.PropertiesOfType)
setpropertyvalue = SetPropertyValue(PropertyID=panel_38, ElementsID=panel_32, SetValue=panel_33, RunThisNode=button)  # -> printToPanel
# ---------- setpropertyvalue: Python ----------
ghenv.Component.Name = 'Set Property Value'
ghenv.Component.NickName = 'SetPropertyValue'
ghenv.Component.Message = '0.1'
ghenv.Component.Category = 'ARCHICAD'
ghenv.Component.SubCategory = 'API3'
ghenv.Component.Description = '''
Sets value of given property GUID
INPUT:
	PropertyID         : string  : GUID of Property
	ElementsID         : dict    : dictionary of elements GUID
	SetValue           : dict    : values packed
						  

OUTPUT:
	PropertyValue 	    : dict 	 : Dicionary with 3 keys: value,type and status
	
'''

import api2 as api
reload(api)


ports = api.get_port()
port = ports[0]

run = api.get_global_toggle()

# def convert_types(value,type_name):
# 	if type_name=='number':return float(value)
# 	if type_name=='string':return str(value)
if len(ports)>0 and (PropertyID is not None and ElementsID is not None and SetValue is not None):
	_elements = api.unpack(ElementsID)
	# _elements = api.unpack(ElementsID)['elements']
	property_value = api.getPropertyValue(_elements,[PropertyID],port)
	
	types = [t['type'] for t in property_value]
	new_values = api.unpack(SetValue)
	# new_values = api.unpack(SetValue)['values']
	# todo: recognize type !!
	types_values = zip(new_values,types)



	
	for i in range(len(new_values)):
		property_value[i]['value'] = api.convert_types(new_values[i],types[i])
		property_value[i]['type'] =  types[i]
		# property_value[i]['value'] =  new_values[i]
	
	# print property_value
	
	if run and RunThisNode:
		printToPanel = api.setPropertyValue(_elements,PropertyID,property_value,port)
	else:
		printToPanel = 'GH scheme is globally turned off. Use Input <RunGlobally> in PickPort Node'
else: 
	printToPanel = '''
INPUT:
	PropertyID : string
	ElementsID : list
OUTPUT:
	printToPanel: message
	'''
# ---------- end setpropertyvalue ----------

setpropertyvalue_2 = SetPropertyValue(PropertyID=panel_38, ElementsID=panel_32, Value=panel_33, SetValue=button)  # -> printToPanel
# ---------- setpropertyvalue_2: Python ----------
ghenv.Component.Name = 'Set Property Value'
ghenv.Component.NickName = 'SetPropertyValue'
ghenv.Component.Message = '0.1'
ghenv.Component.Category = 'ARCHICAD'
ghenv.Component.SubCategory = 'API3'
ghenv.Component.Description = '''
Sets value of given property GUID
INPUT:
	PropertyID         : string  : GUID of Property
	ElementsID         : dict    : dictionary of elements GUID
	Value              : dict    : values packed
    SetValue           : bool    : runs the node
						  

OUTPUT:
	printToPanel: Status of process
	
'''

import api2 as api
reload(api)


ports = api.get_port()
port = ports[0]

run = api.get_global_toggle()

# def convert_types(value,type_name):
# 	if type_name=='number':return float(value)
# 	if type_name=='string':return str(value)
if len(ports)>0 and (PropertyID is not None and ElementsID is not None and Value is not None):
	_elements = api.unpack(ElementsID)
	# _elements = api.unpack(ElementsID)['elements']
	property_value = api.getPropertyValue(_elements,[PropertyID],port)
	
	types = [t['type'] for t in property_value]
	new_values = api.unpack(Value)
	# new_values = api.unpack(SetValue)['values']
	# todo: recognize type !!
	types_values = zip(new_values,types)



	
	for i in range(len(new_values)):
		property_value[i]['value'] = api.convert_types(new_values[i],types[i])
		property_value[i]['type'] =  types[i]
		# property_value[i]['value'] =  new_values[i]
	
	# print property_value
	
	if run and SetValue:
		printToPanel = api.setPropertyValue(_elements,PropertyID,property_value,port)
	else:
		printToPanel = 'GH scheme is globally turned off. Use Input <RunGlobally> in PickPort Node'
else: 
	printToPanel = '''
INPUT:
	PropertyID : string
	ElementsID : list
OUTPUT:
	printToPanel: message
	'''
# ---------- end setpropertyvalue_2 ----------

panel_40 = Panel(setpropertyvalue_2)

# ----
# 5. User Defined Properties
number_slider_7 = Slider(0, range=0..30)

getuseerdefinedpropertyid = GetUserDefinedPropertyID(PropertyGroup=Slider(15, range=0..30), Property=number_slider_7)  # -> printToPanel, PropertyGroups, PropertiesInGroup, PropertyID; inputs PropertyGroup: Int32, Property: Int32
# ---------- getuseerdefinedpropertyid: Python ----------
ghenv.Component.Name = 'Get UserDefined Property ID'
ghenv.Component.NickName = 'GetUseerDefinedPropertyID'
ghenv.Component.Message = '0.1'
ghenv.Component.Category = 'ARCHICAD'
ghenv.Component.SubCategory = 'API3'
ghenv.Component.Description = '''
Picks GUID of User defined Property
INPUT:
	PropertyGroup    : int  		: Picks Property group
	Property         : int  		: Picks properties in a group
						  

OUTPUT:
	printToPanel 	    : Message 	 
	PropertyGroups 	    : Message 	:Property groups based on name prefix 
	PropertiesInGroup	: Message 	:properties in a group

	PropertyID 			: string 	: GUID of property
'''


import api2 as api 
reload(api)
ports = api.get_port()
port = ports[0]

run  = api.get_global_toggle()
print 'sdfs',run
ud_groups , ud_properties = api.getUserDefinedPropertyGroups(port)

if len(ports)>0 or PropertyGroups is not None and Property is not None: 
	PropertyGroup_wrapped = api.get_wrapped_value(PropertyGroup,ud_groups) 
	_group = ud_groups[PropertyGroup_wrapped]
	_properties_in_group = ud_properties[_group]
	Property_wrapped = api.get_wrapped_value(Property,_properties_in_group) 
	print 	Property,Property_wrapped

	PropertyGroups = api.show_menu('GROUPS',ud_groups,PropertyGroup_wrapped)



	PropertiesInGroup = api.show_menu(
		'PROPERTIES IN GROUP "{}"'.format(_group),
		_properties_in_group,
		Property_wrapped
		)
	_property_name = _properties_in_group[Property_wrapped]

	if run:
		PropertyID  = api.getUserDefinedPropertyId(_group,_property_name,port)
		printToPanel = 'Global toggle is on'
	else:
		PropertyID  = ''
		printToPanel = 'GH scheme is globally turned off. Use Input <RunGlobally> in PickPort Node\n'
		

else:
	printToPanel = '''
INPUT:
	PropertyGroups: int
	Property: 		int
OUTPUT:
	PropertyGroups 		:list of groups printed to Panel node
	PropertiesInGroup 	:list of properties in chosen group  printed to Panel node
	PropertyID 			:str Property GUID as string
	'''

# choosen_property_name = ud_properties[Property_wrapped]
# ---------- end getuseerdefinedpropertyid ----------

panel_41 = Panel(getuseerdefinedpropertyid.printToPanel)
panel_42 = Panel(getuseerdefinedpropertyid.PropertyGroups)
panel_43 = Panel(getuseerdefinedpropertyid.PropertyID)
panel_44 = Panel(getuseerdefinedpropertyid.PropertiesInGroup)

# ----
# 4. BuiltInProperties
number_slider_8 = Slider(15, range=0..30)

getbuiltinpropertyid_3 = GetBuiltInPropertyID(PropertyType=number_slider_8, Property=Slider(1, range=0..30))  # -> PropertyGroups, PropertiesOfType, PropertyID; inputs PropertyType: Int32; same code as getbuiltinpropertyid

panel_45 = Panel(getbuiltinpropertyid_3.PropertyGroups)
panel_46 = Panel(getbuiltinpropertyid_3.PropertyID)
panel_47 = Panel(getbuiltinpropertyid_3.PropertiesOfType)

# ----
# 6.  Get Property Value
panel_48 = Panel(panel_2)
panel_49 = Panel(panel_43)
panel_50 = Panel(panel_46)
getpropertyvalue_2 = GetPropertyValue(PropertyID=panel_49, ElementsID=panel_48, SerializeList=Toggle(True))  # -> PropertyValue; inputs SerializeList: Boolean; same code as getpropertyvalue
getpropertyvalue_3 = GetPropertyValue(PropertyID=panel_50, ElementsID=panel_48, SerializeList=Toggle(True))  # -> PropertyValue; inputs SerializeList: Boolean; same code as getpropertyvalue
panel_51 = Panel(getpropertyvalue_2)
list_length_5 = ListLength(List=getpropertyvalue_3)
panel_52 = Panel(getpropertyvalue_3)
panel_53 = Panel(list_length_5)
deserializeproperty_2 = DeserializeProperty(SerializedProperty=panel_52)  # -> PropertyValue, PropertyType, PropertyStatus; same code as deserializeproperty
panel_54 = Panel(deserializeproperty_2.PropertyValue)
panel_55 = Panel(deserializeproperty_2.PropertyType)
panel_56 = Panel(deserializeproperty_2.PropertyStatus)

deserializeproperty_3 = DeserializeProperty(SerializedProperty=panel_51)  # -> PropertyValue, PropertyType, PropertyStatus; same code as deserializeproperty
panel_57 = Panel(deserializeproperty_3.PropertyValue)
panel_58 = Panel(deserializeproperty_3.PropertyType)
panel_59 = Panel(deserializeproperty_3.PropertyStatus)

# ==== cluster SerializeList: Serialize list into string
list = ClusterInput()
valuesseries = Text(list)
text_join = TextJoin(ValuesSeries=valuesseries, Join=";")
packvalues = PackValues(Series=text_join, Delimiter=";")  # -> PackedValues
# ---------- packvalues: Python ----------
import api2 as api

if Series is not None:
    lista=[]
    lista = Series.split(Delimiter)
    PackedValues = api.packlist(lista)
# ---------- end packvalues ----------
serialized_list = ClusterOutput(packvalues)

# ==== cluster FilterElements
elementid = ClusterInput()
criteria = ClusterInput()
values = ClusterInput()
text = Text(values)
ghpython_script = GhPythonScript(ParameterValue=text, ElementID=elementid, CriteriaValue=criteria)  # -> out, a
# ---------- ghpython_script: Python ----------
if CriteriaValue in ParameterValue:
    print ParameterValue,CriteriaValue
    a= ElementID
# ---------- end ghpython_script ----------
pack_values_series = PackValuesSeries(text=ghpython_script.a)
ghpython_script_2 = GhPythonScript(id=pack_values_series)  # -> out, ResultValues
# ---------- ghpython_script_2: Python ----------
import json

lista = json.loads(id)

_lista =[]
for i in lista:
    if len(i)==36:
        _lista.append(i)
        
ResultValues = json.dumps(_lista)
# ---------- end ghpython_script_2 ----------
filteredvalues = ClusterOutput(ghpython_script_2.ResultValues)

# ==== cluster PackValuesSeries: Pack values to one string readable by other nodes
text = ClusterInput()
valuesseries = Text(text)
text_join = TextJoin(ValuesSeries=valuesseries, Join=";")
packvalues = PackValues(Series=text_join, Delimiter=";")  # -> PackedValues; same code as packvalues
text_2 = Text(packvalues)
packedvalues = ClusterOutput(text_2)
