# Grasshopper definition BIMXx_TUTORIAL.gh (Grasshopper 1.0.7)

# ----
# 6.1 For more than one Hypermodel  use Merge Node.
# If names are without asterisks set  input  ‘isString’  to True
hypermodel_01 = Panel("hypemodelName A")
hypermodel_02 = Panel("hypemodelName B")
hypermodel_03 = Panel("hypemodelName C")

# ----
# 7. ElementContextMenu
# This menu appears when element is tapped
# This can  be hypermodel link as well
# Tapping a button will cause a webpage to appear.
# There are three ways they can Show up.
# Modal        -  slide in from right side
# Popoup     -  slide in from below
# Browser    -  open default browser
button_url = Panel("http://archicad-api.com")
button_tittle = Panel("Button")
elementcontext_style = ElementContext_Style({"Modal": "modal", "Browser": "browser", "Popover": "popover"}, selected="Popover")
elementcontext_position = ElementContext_Position({"Left": "left", "Right": "right"}, selected="Right")

# ----
# 5.Project Info
# (Optional)
# 
# Provides a extra button in Project Info section
# with url link
url = Panel("http://archicad-api.com")
button_title = Panel("tAPIr Webpage")

# ----
# 3.DevID
# (Provided)
developer_id = Panel("")

# ----
# 4.Update URL
# (Optional yet very handfull)
# 
# When empty file is already created
# obtain dropbox direct link to a file
# and Pasted to Panel. This link will be used when
# Button “Update extension’ is pressed in BIMx App
# (Note: Currently only  dropbox lilnk is working)
direct_dropbox_link_to_a_extension_bimxx = Panel("")  # "Direct dropbox link to a extension (bimxx) file"

# ----
# 6.HyperModelNames
# (Optional)
# By entering name of HyperModel(s) extension
# functionality will be constrained only
# to those hypermodels
# (name should be provided within asterisks)
hypermodel_name = Panel("\"hypemodelName\"")

# ----
# 2. ExtensionName (Required)
# Name for an extension that will appear
# in ‘BIMx App Settings’
# (three dots in upper right corner )
extension_name = Panel("tutorial_bimxx")

# ----
# Bakes current setup to a extension file (.bimxx)
bake_extension = Button()

# ----
# Note!  BIMx eXtension (.bimxx) works only  with BIMX Pro
# A. BASIC EXTENSION SETUP
# 1. BIMxx File  (Required)
# Choose ‘Set new file location’
# in  node’s context menu
# and point to a dropbox folder
# Give a name to a file
# and provide .bimxx extension
# Obtain Direct link to a file which will be
# needed for loading and updating an extension file
file_path = FilePath("/Users/GrzegorzWilk/Documents/Dropbox/bimx_db/TUTORIAL_BIMXx_BASIC_CONFIGURATION/tutorial.bimxx")

projectinfo = ProjectInfo(Title=button_title, URL=url)  # -> ProjectInfo
# ---------- projectinfo: Python ----------
ghenv.Component.Name = 'Project Info'
ghenv.Component.NickName = 'ProjectInfo'
ghenv.Component.Message = '0.1'
ghenv.Component.Category = 'ARCHICAD_API'
ghenv.Component.SubCategory = 'Bimx'
ghenv.Component.Description = '''
'''

import json
# if Title is not None and URL is not None:
#     titles = Title.split('\n')
#     urls  = URL.split('\n')
#     if len(titles)!=len(urls):
#         ProjectInfo =  'differetn'
#     else:
#         _projectInfo=[]

#         for i,j in enumerate(titles):
#             _projectInfo.append({'title':titles[i],'url':urls[i]})
#         j = json.dumps(_projectInfo,indent=4)
#         ProjectInfo = j
# else:
#     ProjectInfo = 'INPUTS Please'



import json
if Title is not None and URL is not None:
    _elem = {
        'title':Title,
        'url':URL
    }

    j = json.dumps(_elem,indent=4)
    ProjectInfo = j
# ---------- end projectinfo ----------
panel = Panel(projectinfo)

contextmenu = ContextMenu(Title=button_tittle, URL=button_url, Style=elementcontext_style, Position=elementcontext_position)  # -> Elem_context_menu
# ---------- contextmenu: Python ----------
ghenv.Component.Name = 'Context menu'
ghenv.Component.NickName = 'Contextmenu'
ghenv.Component.Message = '0.1'
ghenv.Component.Category = 'ARCHICAD_API'
ghenv.Component.SubCategory = 'Bimx'
ghenv.Component.Description = '''
'''

import json
if Title is not None and URL is not None and Style is not None and Position is not None:
    _elem = {
        'title':Title,
        'url':URL,
        'style': Style,
        'position':Position

    }
    if shownOnlyIf is not None:
        _shownOnlyIf = json.loads(shownOnlyIf)
        _elem['shown_only_if']=_shownOnlyIf
    j = json.dumps(_elem,indent=4)
    Elem_context_menu = j
else:
    print 'Connect all Inputs!!'
# ---------- end contextmenu ----------
panel_2 = Panel(contextmenu)

merge_lists = MergeLists(isstring=Toggle(True), list_1=hypermodel_01, list_2=hypermodel_02, list_3=hypermodel_03)
panel_3 = Panel(merge_lists)

# ----
# BAKE EXTENSION NODE
createextension = CreateExtension(BimxxFile=file_path, BakeBimxxFile=bake_extension, EncryptExtension=0, ExtensionName=extension_name, ProjectInfo=panel)  # inputs BakeBimxxFile: Boolean, EncryptExtension: Boolean
# ---------- createextension: Python ----------
ghenv.Component.Name = 'Create Extension'
ghenv.Component.NickName = 'CreateExtension'
ghenv.Component.Message = '0.1'
ghenv.Component.Category = 'ARCHICAD_API'
ghenv.Component.SubCategory = 'Bimx'
ghenv.Component.Description = '''
'''
import json
from bimx_encoder import  encoder as e 
e=reload(e)
import datetime
now = str(datetime.datetime.now())

bimxx={}
if  BimxxFile is not None and\
    BakeBimxxFile is not None:


    # ProjectInfo is not None and\
    # ElementContextMenu is not None:
    if ExtensionName:bimxx['name'] = ExtensionName#+now 
    if devID:
        bimxx['developer_id'] = devID
    else:
        bimxx['developer_id'] = '8ad9b618-3206-4f60-b7df-24f97986aa65' 
    if UpdateUrl:bimxx['update_url'] = UpdateUrl+'&raw=1'

    if HyperModelNames is not None:
        _hypermodelnames = json.loads(HyperModelNames)
        if isinstance(_hypermodelnames,dict):
            _hypermodelnames = [_hypermodelnames]
        bimxx['hyper_model_names'] = _hypermodelnames#[context_01]
    # bimxx['hyper_model_names'] = ["prj_bimx","WALLS"]

    url_var = [
    '$(hyper_model_name)',
    '$(project_id)',
    '$(project_name)',
    '$(first_measure_point)',
    '$(camera_pos)',
    '$(view_direction)'
    ]
    if ElementContextMenu is not None:
        context = json.loads(ElementContextMenu)
        # print context
        if isinstance(context,dict):
            context = [context]
        bimxx['elem_context_menu'] = context#[context_01]
    #-------------------
    prj_info =  {}
    if ProjectInfo is not None:
        _proj = json.loads(ProjectInfo)#[prj_info]
        if isinstance(_proj,dict):
            _proj = [_proj]
        bimxx['project_info'] = _proj

    if ElementInfo is not None:
        _proj = json.loads(ElementInfo)#[prj_info]
        #if isinstance(_proj,dict):
         #   _proj = [_proj]
        bimxx['elem_info'] = _proj
        
    if ModelInfo is not None:
        _proj = json.loads(ModelInfo)#[prj_info]
        #if isinstance(_proj,dict):
         #   _proj = [_proj]
        bimxx['model_info'] = _proj

    c = json.dumps(bimxx,indent=4)
    print c

    if BakeBimxxFile:
        with open(BimxxFile,'w') as f:
            f.write(c)
#        if EncryptExtension:
#            print 'Extension encrypted'
#            encoder = e.encoder_path()
#            e.encrypt(BimxxFile,encoder,overwrite=True)
#   Feature not implemented yet. Require bimxx encoder that can be found here
#   https://graphisoft.sharefile.com/d-s13ee1be5fc4d44caa108bd81d3c7196f
#   Input parameter name (type bool) <EncryptExtension>

else:
    print 'Connect all Inputs!!'
# ---------- end createextension ----------

# ==== cluster MergeLists: Merge lists and serialize them
list_7 = ClusterInput()
list_1 = ClusterInput()
list_2 = ClusterInput()
list_3 = ClusterInput()
list_4 = ClusterInput()
list_5 = ClusterInput()
list_6 = ClusterInput()
isstring = ClusterInput()
merge = Merge(Data1=list_1, Data2=list_2, Data3=list_3, Data4=list_4, Data5=list_5, Data6=list_6, Data7=list_7)
string = GhPythonScript(isString=isstring, values=merge)  # -> out, result
# ---------- string: Python ----------
if isString:
    result = '"'+values+'"'
else:
    result =  values
# ---------- end string ----------
text_join = TextJoin(Text=string.result, Join=",")
concatenate = Concatenate(FragmentA="[", FragmentB=text_join)
concatenate_2 = Concatenate(FragmentA=concatenate, FragmentB="]")
serialized_list = ClusterOutput(concatenate_2)
